# Grasshopper definition Computational_Workflow.gh (Grasshopper 1.0.8)
# plug-ins: Human, Weaverbird, Pancake

# Original Plan
geometry = Geometry(<curve referenced from the Rhino model>)
point = Point(<point referenced from the Rhino model>)
number_slider = Slider(0.995, range=0..1)
geometry_2 = Geometry(<curve referenced from the Rhino model>)
geometry_3 = Geometry(<curve referenced from the Rhino model>)
length = Length(Curve=geometry_2)
panel = Panel(length)
number_slider_2 = Slider(150, range=0..1000)

# ----
# D:\onedrive\OneDrive - Delft University of Technology\Lunar Architecture&Infrastructure_Graduation_Studio\PRESENTATION\ILLUSTRATION\ANIME\Floating\floating{0:0000}.obj
# D:\onedrive\OneDrive - Delft University of Technology\Lunar Architecture&Infrastructure_Graduation_Studio\CAD\3D_Files\Movement\TYPE.obj
# D:\onedrive\OneDrive - Delft University of Technology\Lunar Architecture&Infrastructure_Graduation_Studio\PRESENTATION\ILLUSTRATION\ANIME\New Folder\Sitting{0:0000}.obj
panel_2 = Panel("D:\onedrive\OneDrive - Delft University of Technology\Lunar Architecture&Infrastructure_Graduation_Studio\PRESENTATION\ILLUSTRATION\ANIME\Sitting\Moon Sitting{0:0000}.obj")
panel_3 = Panel("D:\onedrive\OneDrive - Delft University of Technology\Lunar Architecture&Infrastructure_Graduation_Studio\CAD\3D_Files\Movement\WAKING.obj")

number_slider_3 = Slider(0, range=0..150)

# ----
# D:\onedrive\OneDrive - Delft University of Technology\Lunar Architecture&Infrastructure_Graduation_Studio\CAD\Digital_Files\HUMAN_MOVEMENT_STUDY\floating_bones.csv
# D:\onedrive\OneDrive - Delft University of Technology\Lunar Architecture&Infrastructure_Graduation_Studio\CAD\Digital_Files\HUMAN_MOVEMENT_STUDY\TYPING_bones.csv
# D:\onedrive\OneDrive - Delft University of Technology\Lunar Architecture&Infrastructure_Graduation_Studio\CAD\Digital_Files\HUMAN_MOVEMENT_STUDY\SITTING_bones.csv
panel_4 = Panel("D:\onedrive\OneDrive - Delft University of Technology\Lunar Architecture&Infrastructure_Graduation_Studio\CAD\Digital_Files\HUMAN_MOVEMENT_STUDY\WAKING_bones.csv")

negative = Negative(Value=Slider(0.5, range=0..10))
addition = Addition(B=negative)
list_item = ListItem(List=number_slider_2, Index=Slider(40, range=0..100), Wrap=True)
xz_plane = XZPlane(Origin=Point(0, 0, 0))
xy_plane = XYPlane(Origin=Point(0, 0, 0))
radians = Radians(Degrees=Slider(90, range=0..100))
negative_2 = Negative(Value="135")
yz_plane = YZPlane(Origin=Point(0, 0, 0))
radians_2 = Radians(Degrees=negative_2)
negative_3 = Negative(Value=Slider(0, range=0..1))
negative_4 = Negative(Value=Slider(0.4, range=0..10))
radians_3 = Radians(Degrees="90")
xz_plane_2 = XZPlane(Origin=Point(0, 0, 0))
panel_5 = Panel("""0
25
26
27""")
radians_4 = Radians(Degrees="0")
yz_plane_2 = YZPlane(Origin=Point(0, 0, 0))
panel_6 = Panel("""0.02
0.04""")
negative_5 = Negative(Value="135")
yz_plane_3 = YZPlane(Origin=Point(0, 0, 0))
radians_5 = Radians(Degrees=negative_5)
unit_z = UnitZ(Factor=Slider(0, range=0..1))
number_slider_4 = Slider(0, range=0..100)
unit_y = UnitY(Factor=Slider(0.5, range=0..1))
panel_7 = Panel("Grey")
panel_8 = Panel("MyFilm")
number_slider_5 = Slider(1, range=0..1)
unit_x = UnitX(Factor=Slider(0.5, range=0..1))
colour_swatch = ColourSwatch(SwatchColor=RGB(0, 21, 255))
colour_swatch_2 = ColourSwatch(SwatchColor=RGB(93, 104, 252))
number_slider_6 = Slider(1, range=0..1)
panel_9 = Panel("Lighting")
number_slider_7 = Slider(0.001, range=0..0.001)

# ---- group: path generate
curve = Curve(<curve referenced from the Rhino model>)
point_2 = Point(<point referenced from the Rhino model>)
point_3 = Point(<point referenced from the Rhino model>)
point_4 = Point(<point referenced from the Rhino model>)
curve_2 = Curve(<curve referenced from the Rhino model>)
curve_3 = Curve(<curve referenced from the Rhino model>)
merge = Merge(Data1=curve, Data2=curve_2)
point_5 = Point(<point referenced from the Rhino model>)
point_6 = Point(<point referenced from the Rhino model>)

# ----
area = Area(Geometry=curve)  # -> Area, Centroid
# Human Movement Path
scale = Scale(Geometry=curve, Center=area.Centroid, Factor=Slider(0.4, range=0..1))  # -> Geometry, Transform
flip_curve = FlipCurve(Curve=curve_3)  # -> Curve, Flag

# ---- group: path generate (continued)
operator = Python3Script(full_path=flip_curve.Curve, t_progress=number_slider)  # -> current_pos, traveled_path, a
# ---------- operator: Python ----------
import Rhino.Geometry as rg

TOL = 0.001

# 确保输入有效
if full_path and t_progress is not None:
    # 1. 获取曲线的定义域（Domain）
    # full_path.Domain.T0 是起点参数，T1 是终点参数
    d_start = full_path.Domain.T0
    d_end = full_path.Domain.T1
    
    # 2. 根据进度 (0.0 - 1.0) 映射出具体的参数 t_param
    # 公式：起点 + (总跨度 * 进度百分比)
    t_param = d_start + (d_end - d_start) * t_progress
    
    # 3. 输出 A：计算当前位置的点
    current_pos = full_path.PointAt(t_param)
    
    # 4. 输出 B：截取走过的路径
    # 使用 Trim 方法从起点截取到当前参数点
    traveled_path = full_path.Trim(d_start, t_param)
    
# 强制将计算结果映射到端口
a = current_pos
current_pos = current_pos
traveled_path = traveled_path
# ---------- end operator ----------
observer = Python3Script(
    start_pt=point_2,
    end_pt=point_5,
    TargetDir=point_6,
    op_path=flatten(operator.traveled_path),
    t_progress=number_slider,
    obstacle=merge)  # -> current_pos, traveled_path, full_path, debug_out, a; inputs op_path: Curve, t_progress: Double, obstacle: list of Curve
# ---------- observer: Python ----------
import Rhino.Geometry as rg
import math
import traceback

def dijkstra(nodes, edges, start_idx, end_idx):
    """标准 Dijkstra 算法实现"""
    dist = {i: float('inf') for i in range(len(nodes))}
    prev = {i: None for i in range(len(nodes))}
    dist[start_idx] = 0
    unvisited = set(range(len(nodes)))
    while unvisited:
        curr = min(unvisited, key=lambda i: dist[i])
        if dist[curr] == float('inf') or curr == end_idx: break
        unvisited.remove(curr)
        for neighbor in edges[curr]:
            if neighbor in unvisited:
                alt = dist[curr] + nodes[curr].DistanceTo(nodes[neighbor])
                if alt < dist[neighbor]:
                    dist[neighbor] = alt
                    prev[neighbor] = curr
    path = []
    curr = end_idx
    while curr is not None:
        path.append(curr); curr = prev[curr]
    return path[::-1] if path and path[-1] == start_idx else []

def smooth_polyline(pts, fillet_r=0.4):
    """路径平滑与倒角处理"""
    if len(pts) <= 2: return rg.PolylineCurve(pts)
    segments = []
    last_pt = pts[0]
    for i in range(1, len(pts)-1):
        p_p, p_c, p_n = pts[i-1], pts[i], pts[i+1]
        v_in, v_out = p_p - p_c, p_n - p_c
        r = min(fillet_r, v_in.Length * 0.4, v_out.Length * 0.4)
        v_in.Unitize(); v_out.Unitize()
        pt_in, pt_out = p_c + v_in * r, p_c + v_out * r
        if last_pt.DistanceTo(pt_in) > 0.001: segments.append(rg.LineCurve(last_pt, pt_in))
        segments.append(rg.BezierCurve([pt_in, p_c, pt_out]).ToNurbsCurve())
        last_pt = pt_out
    segments.append(rg.LineCurve(last_pt, pts[-1]))
    joined = rg.Curve.JoinCurves(segments, 0.01)
    return joined[0] if joined else rg.PolylineCurve(pts)

# 初始化变量
current_pos, current_tangent, full_path, traveled_path = None, None, None, None
debug_log = []
debug_geometry = []

try:
    # 1. 基础参数清理 (强制对齐 Z 轴)
    R_OBS = 0.6  # 避障半径
    target_z = start_pt.Z
    s_p = rg.Point3d(start_pt.X, start_pt.Y, target_z)
    e_p = rg.Point3d(end_pt.X, end_pt.Y, target_z)
    t_d_p = rg.Point3d(TargetDir.X, TargetDir.Y, target_z)
    
    # 2. 障碍物处理 (生成偏移后的安全区)
    obs_list = obstacle if isinstance(obstacle, list) else [obstacle]
    safe_zones = []
    for obs in obs_list:
        if not obs: continue
        # 统一投影到 XY 平面以防干扰
        obs_flat = rg.Curve.ProjectToPlane(obs, rg.Plane(rg.Point3d(0,0,target_z), rg.Vector3d.ZAxis))
        # 尝试向外偏移
        off = obs_flat.Offset(rg.Plane.WorldXY, R_OBS, 0.01, rg.CurveOffsetCornerStyle.Sharp)
        if not off: # 备选方向
            off = obs_flat.Offset(rg.Plane.WorldXY, -R_OBS, 0.01, rg.CurveOffsetCornerStyle.Sharp)
        if off:
            safe_zones.extend(off)
            debug_geometry.extend(off)

    # 3. 提取所有关键节点
    nodes = [s_p, e_p]
    for sz in safe_zones:
        res, poly = sz.TryGetPolyline()
        if res:
            pts = list(poly)
            if pts[0].DistanceTo(pts[-1]) < 0.01: pts.pop()
            nodes.extend(pts)
    
    # 4. 视线网构建 (核心防穿墙判定)
    edges = {i: [] for i in range(len(nodes))}
    for i in range(len(nodes)):
        for j in range(i+1, len(nodes)):
            line = rg.Line(nodes[i], nodes[j])
            line_crv = rg.LineCurve(line)
            
            is_blocked = False
            # --- 强化判定策略 ---
            for zone in safe_zones:
                # A. 采样检测：在线段上取 7 个点，检测是否进入障碍物内部
                for t in [0.15, 0.3, 0.5, 0.7, 0.85]:
                    test_pt = line_crv.PointAtNormalizedLength(t)
                    if zone.Contains(test_pt, rg.Plane.WorldXY, 0.001) == rg.PointContainment.Inside:
                        is_blocked = True; break
                if is_blocked: break
                
                # B. 相交检测：检测线段是否横穿边界
                it = rg.Intersect.Intersection.CurveCurve(line_crv, zone, 0.001, 0.001)
                if it and any(0.01 < x.ParameterA < 0.99 for x in it):
                    is_blocked = True; break
            
            if not is_blocked:
                edges[i].append(j)
                edges[j].append(i)

    # 5. 执行寻路
    path_idx = dijkstra(nodes, edges, 0, 1)
    
    if path_idx and len(path_idx) >= 2:
        # 如果节点数 > 2，说明成功避障绕行
        raw_pts = [nodes[k] for k in path_idx]
        
        # 6. 后处理：平滑与转向
        base_crv = smooth_polyline(raw_pts, 0.6)
        
        # 拼接末端转向逻辑
        LookAhead = 1.2
        total_l = base_crv.GetLength()
        if total_l > LookAhead:
            res, t_s = base_crv.LengthParameter(total_l - LookAhead)
            c1 = base_crv.Trim(base_crv.Domain.T0, t_s)
            p_s, v_s = base_crv.PointAt(t_s), base_crv.TangentAt(t_s)
        else:
            c1 = None
            p_s, v_s = s_p, e_p - s_p
            
        v_e = (t_d_p - e_p); v_e.Unitize(); v_s.Unitize()
        h = p_s.DistanceTo(e_p) * 0.5
        tail = rg.BezierCurve([p_s, p_s + v_s*h, e_p - v_e*h, e_p]).ToNurbsCurve()
        
        curves_to_join = []
        if c1: curves_to_join.append(c1)
        curves_to_join.append(tail)
        full_path = rg.Curve.JoinCurves(curves_to_join, 0.01)[0]
        
        # 7. 进度输出
        t_val = t_progress[0] if isinstance(t_progress, list) else t_progress
        res, rt = full_path.NormalizedLengthParameter(max(0, min(1, t_val)))
        current_pos = full_path.PointAt(rt)
        current_tangent = full_path.TangentAt(rt)
        traveled_path = full_path.Trim(full_path.Domain.T0, rt)
        
        debug_log.append("✅ 路径计算成功")
    else:
        debug_log.append("❌ 未能找到避障路径 (可能被完全封死)")

except Exception as e:
    debug_log.append("🚨 脚本崩溃: " + str(e))
    debug_log.append(traceback.format_exc())

# 电池端口输出
a = debug_geometry    # 连到 Geometry 看看偏移框对不对
debug_out = "\n".join(debug_log)
# ---------- end observer ----------

subject = Python3Script(
    start_pt=point_2,
    end_pt=point_4,
    TargetDir=point_3,
    op_path=flatten(operator.traveled_path),
    t_progress=Slider(1, range=0..1),
    obstacle=scale.Geometry)  # -> current_pos, traveled_path, full_path, debug_out, debug_geo; inputs start_pt: Point3d, end_pt: Point3d, op_path: Curve, t_progress: Double
# ---------- subject: Python ----------
import Rhino.Geometry as rg
import math
import traceback

# 初始化
current_pos = None
current_tangent = None 
full_path = None
traveled_path = None
debug_log = []
dbg_out = [] 

def log(msg): debug_log.append(msg)
def add_point(pt): dbg_out.append(pt)

try:
    log("--- 🛡️ 终极外围包裹 (Rubber Band) + 绝对到达终点版 ---")
    
    t_raw_val = t_progress[0] if isinstance(t_progress, (list, tuple)) else t_progress
    t_val = max(0.0, min(1.0, float(t_raw_val))) 

    # ==========================================
    # 🏁 1. 终点 (End Point) 的绝对影响与降落跑道
    # ==========================================
    # 提取推力方向 TargetDir
    if isinstance(TargetDir, rg.Vector3d): push_vec = rg.Vector3d(TargetDir)
    else: push_vec = TargetDir - end_pt
    if push_vec.Length < 1e-5: push_vec = end_pt - start_pt 
    push_vec.Z = 0
    push_vec.Unitize()

    # RUNWAY (降落跑道): 保证路径最终【一定】会沿着 TargetDir 走到 end_pt
    RUNWAY_LEN = 0.5 # 缩短的跑道
    actual_runway = min(RUNWAY_LEN, start_pt.DistanceTo(end_pt) * 0.45)
    lead_in_pt = end_pt - push_vec * actual_runway
    
    # 🌟 重点显影：明确画出这段最终走向 end_pt 的直线跑道！
    dbg_out.append(rg.LineCurve(lead_in_pt, end_pt))
    add_point(end_pt) # 明确显影终点！
    add_point(lead_in_pt)

    # ==========================================
    # 👁️ 2. 双重障碍物定义 (大楼角点 + Operator)
    # ==========================================
    # 障碍物 1：大楼角点
    success_poly, polyline = obstacle.TryGetPolyline()
    key_corner = sorted(list(polyline), key=lambda cp: rg.Line(start_pt, lead_in_pt).DistanceTo(cp, True))[0]
    R_OBS = min(0.8, start_pt.DistanceTo(key_corner) * 0.95, lead_in_pt.DistanceTo(key_corner) * 0.95)
    obs_circle = rg.Circle(rg.Plane.WorldXY, key_corner, R_OBS).ToNurbsCurve()
    dbg_out.append(obs_circle)

    # 障碍物 2：Operator 的势力场
    normalized_t = op_path.Domain.T0 + (op_path.Domain.T1 - op_path.Domain.T0) * t_val
    op_current_pt = op_path.PointAt(normalized_t)
    R_OP = 0.4 # 按照你的要求缩小
    op_circle = rg.Circle(rg.Plane.WorldXY, op_current_pt, R_OP).ToNurbsCurve()
    dbg_out.append(op_circle)

    # ==========================================
    # 🌟 3. 外围判断：动态生成“包裹折线” 
    # ==========================================
    # 我们用一条贯穿前后的基础线来判断
    base_line = rg.Line(start_pt, lead_in_pt)
    v_base = lead_in_pt - start_pt
    if v_base.Length > 1e-5: v_base.Unitize()
    else: v_base = rg.Vector3d.XAxis

    # 将两个障碍物打包，并按照离起点的远近排序（确保按顺序避让）
    obstacles = [
        {'center': key_corner, 'r': R_OBS, 'name': 'Building'},
        {'center': op_current_pt, 'r': R_OP, 'name': 'Operator'}
    ]
    obstacles.sort(key=lambda o: rg.Vector3d.Multiply(o['center'] - start_pt, v_base))

    poly_pts = [start_pt]

    for obs in obstacles:
        C = obs['center']
        R = obs['r']
        # 判断小人的视线是否穿透了这个圆
        dist = base_line.DistanceTo(C, True)
        if dist < R:
            log("🔴 触发外围避让: " + obs['name'])
            # 计算向外推的向量 (垂直于基础视线)
            side = 1 if rg.Vector3d.CrossProduct(v_base, C - start_pt).Z < 0 else -1
            v_out = rg.Vector3d.CrossProduct(v_base, rg.Vector3d.ZAxis) * side
            v_out.Unitize()
            
            # 将路点强行向外推，形成一个安全的中转点 (多加 0.1m 防止擦边)
            safe_pt = C + v_out * (R + 0.1)
            poly_pts.append(safe_pt)
            add_point(safe_pt) # 显影挤在外围的安全点

    # 无论前面怎么绕，最后两步【一定】是连接到引航点，然后扎进终点！
    poly_pts.append(lead_in_pt)
    poly_pts.append(end_pt)

    # ==========================================
    # 🪢 4. 工业倒角：把硬折线打磨成丝滑曲线
    # ==========================================
    poly_crv = rg.PolylineCurve(poly_pts)
    fillet_radius = 1.0 # 倒角半径，保证转弯圆滑
    
    # 用 Rhino 极度稳定的倒角算法，它永远不会像贝塞尔那样甩肚子穿模！
    full_path = rg.Curve.CreateFilletCornersCurve(poly_crv, fillet_radius, 0.01, 0.1)
    if not full_path:
        full_path = poly_crv 
        log("⚠️ 角度刁钻，输出硬折线保底")
    else:
        log("✅ 外围包裹曲线生成！终点已严格到达！")

    # 提取进度与截断
    success_t, real_t = full_path.NormalizedLengthParameter(t_val)
    if success_t:
        current_pos = full_path.PointAt(real_t)
        current_tangent = full_path.TangentAt(real_t)
        if t_val <= 0.001: traveled_path = None
        elif t_val >= 0.999: traveled_path = full_path
        else: traveled_path = full_path.Trim(full_path.Domain.T0, real_t)

except Exception:
    log(traceback.format_exc())

debug_geo = dbg_out
debug_out = "\n".join(debug_log)
# ---------- end subject ----------

# ----
# [Actor 0]
# Delay: 0.0
# EndMode: Freeze
# 0.0, 2.066134, 0
# 2.066134,8.736,1
# 
# [Actor 1]
# Delay: 8.0
# EndMode: Freeze
# 0.0, 4.432352, 0
# 4.432352, 6.832352, 1
panel_10 = Panel("""[Actor 0]
Delay: 0.0
EndMode: Freeze
0.0, 2.066134, 0
2.066134,8.736,1

[Actor 1]
Delay: 8.0
EndMode: Freeze
0.0, 4.432352, 0
4.432352, 6.832352, 1""")
bounds = Bounds(Numbers=flatten(length))
panel_11 = Panel("""0, 60, 0, 0.5, 0.6
1, 118, 1, 1.0, 0.6
2, 74, 0, 1.0, 1.0""")
deconstruct_domain = DeconstructDomain(Domain=bounds)  # -> Start, End
python_3_script = Python3Script(
    crvs=flatten(geometry_2),
    Script=panel_10,
    ActionFrames=panel_11,
    Play=Toggle(False),
    Reset=Button(),
    Speed=Slider(0.97, range=0..1))  # -> dist_list, action_id_list, index_list, visible_mask, current_dist; inputs crvs: list of Curve, Script: String, ActionFrames: String
# ---------- python_3_script: Python ----------
import scriptcontext as sc
import Rhino.Geometry as rg
import Grasshopper as gh

# ============================================================
# 1. Input Initialization and Safety Checks
# ============================================================
play = bool(Play) if Play is not None else False
reset = bool(Reset) if Reset is not None else False
speed = float(Speed) if Speed is not None else 0.02

if not crvs: raise Exception("Please connect the path curves (crvs)")
if not ActionFrames: raise Exception("Please connect the action library (ActionFrames)")

# 🌟 Automatically get the actual length of the first curve (i.e., your 3.566748)
crv = crvs[0]
crv_len = crv.GetLength()

# ============================================================
# 2. Action Profile Library Parsing (Defaults to Action ID 0)
# ============================================================
f_count, is_stat, spd_mult, phys_mult = 60, 0, 1.0, 1.0

for line in str(ActionFrames).split('\n'):
    parts = line.strip().split(',')
    if len(parts) >= 2:
        act_id = int(parts[0])
        if act_id == 0: # Lock and match Action ID 0 in the action library
            f_count = int(parts[1])
            is_stat = int(parts[2]) if len(parts)>=3 else 0
            spd_mult = float(parts[3]) if len(parts)>=4 else 1.0 
            phys_mult = float(parts[4]) if len(parts)>=5 else 1.0
            break

# ============================================================
# 3. Core Timer and Displacement Driver
# ============================================================
# Reset or initialize cache
if reset or "single_actor_dist" not in sc.sticky: 
    sc.sticky["single_actor_dist"] = 0.0

if play:
    # Calculate new displacement combined with the physical movement weight of the current action
    sc.sticky["single_actor_dist"] += speed * phys_mult
    
    # 🌟 Core Modification: Freeze once reaching the end of the curve (Freeze Mode)
    if sc.sticky["single_actor_dist"] > crv_len:
        sc.sticky["single_actor_dist"] = crv_len

    # Automatically trigger millisecond-level viewport refresh in Grasshopper
    if "ghenv" in globals():
        doc = ghenv.Component.OnPingDocument()
        if doc: doc.ScheduleSolution(20, lambda d: ghenv.Component.ExpireSolution(False))

# Get the actual distance covered currently
local_dist = sc.sticky["single_actor_dist"]

# ============================================================
# 4. Calculate the Current Animation Frame Index
# ============================================================
base_step = 0.8 / 30.0
frame_dist_step = base_step * spd_mult

if frame_dist_step > 0:
    total_passed_frames = int(local_dist / frame_dist_step)
    if is_stat == 0:
        current_frame = total_passed_frames % f_count # Looping action
    else:
        current_frame = min(total_passed_frames, f_count - 1) # Static / Single-shot action
else:
    current_frame = 0

# ============================================================
# 5. Unified Outputs (Maintain original parameter structure to prevent downstream component errors)
# ============================================================
dist_list = [local_dist]
action_id_list = [0]
index_list = [current_frame]
visible_mask = [True]
current_dist = local_dist
# ---------- end python_3_script ----------
construct_domain = ConstructDomain(DomainStart=0, DomainEnd=deconstruct_domain.End)
remap_numbers = RemapNumbers(Value=python_3_script.current_dist, Source=construct_domain, Target=Domain(0, 1))  # -> Mapped, Clipped
panel_12 = Panel("D:\onedrive\OneDrive - Delft University of Technology\Lunar Architecture&Infrastructure_Graduation_Studio\PRESENTATION\ILLUSTRATION\ANIME\Jump\Jump{0:0000}.obj")
series = Series(Start=Slider(0, range=0..100), Step=Slider(1, range=0..1), Count=number_slider_2)
series_2 = Series(Start=Slider(0, range=0..100), Step=Slider(1, range=0..1), Count=Slider(119, range=0..1000))
series_3 = Series(Start=Slider(75, range=0..100), Step=Slider(1, range=0..1), Count=Slider(176, range=0..1000))
format = Format(Format=panel_12, Culture=127, Data0=series_3)
format_2 = Format(Format=panel_2, Culture=127, Data0=series_2)
format_3 = Format(Format=panel_2, Culture=127, Data0=series)
pcimportobj = ImportOBJ(File=graft(format_3), MapYtoZ=False, LastSaveLocalization="neutral,N")
pcimportobj_2 = ImportOBJ(File=graft(format), MapYtoZ=False, LastSaveLocalization="neutral,N")
pcimportobj_3 = ImportOBJ(File=graft(format_2), MapYtoZ=False, LastSaveLocalization="neutral,N")
list_item_2 = ListItem(List=flatten(pcimportobj_2), Index=python_3_script.action_id_list, Wrap=True)
list_item_3 = ListItem(List=flatten(pcimportobj_3), Index=list_item, Wrap=True)
rotate = Rotate(Geometry=list_item_3, Angle=Slider(88, range=0..100), Plane=PlaneXY(0, 0, 0))  # -> Geometry, Transform

addition_2 = Addition(A=remap_numbers.Clipped, B=Slider(0.1, range=0..0.1))
horizontal_frame = HorizontalFrame(Curve=reparameterize(geometry_2), Parameter=addition_2)
panel_13 = Panel(addition_2)
format_4 = Format(Format=panel_3, Culture=127, Data0=series)
pcimportobj_4 = ImportOBJ(File=graft(format_4), MapYtoZ=False, LastSaveLocalization="neutral,N")
list_item_4 = ListItem(List=flatten(pcimportobj), Index=list_item, Wrap=True)
area_2 = Area(Geometry=rotate.Geometry)  # -> Area, Centroid
deconstruct = Deconstruct(Point=area_2.Centroid)  # -> XComponent, YComponent, ZComponent
addition_3 = Addition(A=deconstruct.XComponent, B=Slider(0.6, range=0.1..1))
unit_x_2 = UnitX(Factor=addition_3)
vector_xyz = VectorXYZ(XComponent=unit_x_2, YComponent=0, ZComponent=0)  # -> Vector, Length
move = Move(Geometry=rotate.Geometry, Motion=vector_xyz.Vector)  # -> Geometry, Transform

evaluate_curve = EvaluateCurve(Curve=reparameterize(geometry_2), Parameter=remap_numbers.Clipped)  # -> Point, Tangent, Angle
# Evolutionary Plan
horizontal_frame_2 = HorizontalFrame(Curve=reparameterize(geometry_2), Parameter=remap_numbers.Clipped)

geometry_4 = Geometry(<curve referenced from the Rhino model>)
geometry_5 = Geometry(<curve referenced from the Rhino model>)
divide_curve = DivideCurve(Curve=[geometry_4, geometry_5], Count=Slider(50, range=0..100), Kinks=False)  # -> flatten(Points), Tangents, Parameters
deconstruct_2 = Deconstruct(Point=divide_curve.Points)  # -> XComponent, YComponent, ZComponent
merge_2 = Merge(Data1=geometry_4, Data2=geometry_5)
average = Average(Input=deconstruct_2.XComponent)
average_2 = Average(Input=deconstruct_2.YComponent)
average_3 = Average(Input=deconstruct_2.ZComponent)
construct_point = ConstructPoint(XCoordinate=average, YCoordinate=average_2, ZCoordinate=average_3)
unit_z_2 = UnitZ(Factor=Slider(0.844, range=0..1))

radians_6 = Radians(Degrees=Slider(90, range=0..100))
geometry_6 = Geometry(construct_point)

rotate_plane = RotatePlane(Plane=horizontal_frame_2, Angle=radians_6)
orient = Orient(Geometry=graft(merge_2), Source=geometry_6, Target=rotate_plane)  # -> Geometry, Transform
move_2 = Move(Geometry=orient.Geometry, Motion=unit_z_2)  # -> flatten(Geometry), Transform
list_item_5 = ListItem(List=move_2.Geometry, Index="0", Wrap=True)
list_item_6 = ListItem(List=move_2.Geometry, Index="1", Wrap=True)

evaluate_curve_2 = EvaluateCurve(Curve=reparameterize(geometry_2), Parameter=remap_numbers.Clipped)  # -> Point, Tangent, Angle
# Human Movement
number_slider_8 = Slider(0.1, range=0..0.1)
number_slider_9 = Slider(0.01, range=0..0.01)
boolean_toggle = BooleanToggle(True)
colour_swatch_3 = ColourSwatch(SwatchColor=RGB(0, 43, 255))

radians_7 = Radians(Degrees="235")
rotate_plane_2 = RotatePlane(Plane=horizontal_frame_2, Angle=radians_7)
deconstruct_arc = DeconstructArc(Arc=geometry)  # -> BasePlane, Radius, Angle
unit_z_3 = UnitZ(Factor=Slider(0.371, range=0..1))
orient_2 = Orient(Geometry=graft(geometry), Source=deconstruct_arc.BasePlane, Target=rotate_plane_2)  # -> Geometry, Transform
number_slider_10 = Slider(1, range=0..1)
number_slider_11 = Slider(0.05, range=0..1)

circle = Circle(Plane=rotate_plane_2, Radius=Slider(0.6, range=0..1))
divide_curve_2 = DivideCurve(Curve=circle, Count=Slider(20, range=0..100), Kinks=False)  # -> Points, Tangents, Parameters
python_3_script_2 = Python3Script(
    C=flatten(evaluate_curve_2.Point),
    Pts_A=divide_curve_2.Points,
    Tangent=evaluate_curve_2.Tangent,
    Curve=flatten(geometry_2),
    t=remap_numbers.Clipped,
    Sensitivity=Slider(2, range=0..10),
    Min_Len=Slider(0, range=0..100),
    Max_Len=Slider(1, range=0..1),
    Asymmetry_Power=Slider(0.5, range=0..1))  # -> Out_Lines, Out_Pts_B, Out_Vectors, Out_Debug; inputs C: Point3d, Pts_A: list, Tangent: Vector3d, Curve: Curve, t: Double, Sensitivity: Double, Min_Len: Double, Max_Len: Double, Asymmetry_Power: Double
# ---------- python_3_script_2: Python ----------
# -*- coding: utf-8 -*-
"""
[Component: 10-Channel Parallel Generator ── Soft Inflatable Differential Exaggerated Edition]
"""
import Rhino.Geometry as rg
import math

sens = float(Sensitivity) if 'Sensitivity' in globals() and Sensitivity is not None else 5.0
r_min = float(Min_Len) if 'Min_Len' in globals() and Min_Len is not None else 0.2
r_max = float(Max_Len) if 'Max_Len' in globals() and Max_Len is not None else 2.0
asym_pwr = float(Asymmetry_Power) if 'Asymmetry_Power' in globals() and Asymmetry_Power is not None else 1.0

Out_Pts_B = []
debug_log = []

if 'C' in globals() and C and 'Pts_A' in globals() and Pts_A and 'Tangent' in globals() and Tangent and 'Curve' in globals() and Curve:
    try:
        v_front = rg.Vector3d(Tangent.X, Tangent.Y, 0)
        if v_front.Length > 1e-5: v_front.Unitize()
        else: v_front = rg.Vector3d(1, 0, 0)
        v_left = rg.Vector3d(-v_front.Y, v_front.X, 0)
            
        success, true_t = Curve.ClosestPoint(C)
        
        if success:
            step = Curve.Domain.Length * 0.03
            t_ahead = true_t + step
            if t_ahead > Curve.Domain.T1: t_ahead = Curve.Domain.T1
            if t_ahead < Curve.Domain.T0: t_ahead = Curve.Domain.T0
                
            v_ahead = Curve.TangentAt(t_ahead)
            v_ahead.Z = 0 
            if v_ahead.Length > 1e-5: v_ahead.Unitize()
            
            turn_intensity = (v_front.X * v_ahead.Y) - (v_front.Y * v_ahead.X)
            
            angle_deflect = -turn_intensity * sens
            rot_trans = rg.Transform.Rotation(angle_deflect, rg.Vector3d.ZAxis, rg.Point3d(C.X, C.Y, C.Z))
            
            v_parallel = rg.Vector3d(v_front.X, v_front.Y, v_front.Z)
            v_parallel.Transform(rot_trans)
            v_parallel.Unitize()
            
            for i, pt_A in enumerate(Pts_A):
                if pt_A is None: continue
                
                v_radial = pt_A - C
                v_radial.Z = 0 
                if v_radial.Length > 1e-5: v_radial.Unitize()
                else: v_radial = rg.Vector3d(1, 0, 0)
                
                front_bias = v_radial.X * v_front.X + v_radial.Y * v_front.Y
                side_indicator = v_radial.X * v_left.X + v_radial.Y * v_left.Y
                
                base_len = r_min + ((front_bias + 1.0) / 2.0 * (r_max - r_min))
                
                # === 🎈 Core Adjustment 1: Widen Left-Right Pressure Differential ===
                # Increased the amplification factor from 4.0 to 10.0, causing the expanding side to become instantly thick
                asym_shift = turn_intensity * sens * side_indicator * asym_pwr * 10.0
                
                # Allow the inner side to shrink more extremely (0.05x), almost flushing against the user's body
                final_multiplier = max(0.05, (1.0 + asym_shift)) 
                unclamped_len = base_len * final_multiplier
                
                # === 🎈 Core Adjustment 2: Firmly Suppress Forward Length ===
                # Lowered the ceiling to 1.2x. This ensures that no matter how exaggerated the left and right sides are, the overall geometry won't overshoot forward too much
                safety_ceiling = r_max * 1.2 
                
                final_len = max(0.01, min(safety_ceiling, unclamped_len))
                
                pt_B = pt_A + (v_parallel * final_len)
                Out_Pts_B.append(pt_B)
                
    except Exception as e:
        debug_log.append("❌ Error: " + str(e))
        
    Out_Debug = "\n".join(debug_log)
# ---------- end python_3_script_2 ----------
geometry_7 = Geometry(python_3_script_2.Out_Pts_B)
line = Line(StartPoint=divide_curve_2.Points, EndPoint=geometry_7)
sphere = Sphere(Base=divide_curve_2.Points, Radius=Slider(0.02, range=0..0.1))
vector_2pt = Vector2Pt(PointA=divide_curve_2.Points, PointB=geometry_7, Unitize=False)  # -> Vector, Length
plane_normal = PlaneNormal(Origin=geometry_7, ZAxis=vector_2pt.Vector)
cone = Cone(Base=plane_normal, Radius=Slider(0.02, range=0..0.1), Length=number_slider_8)  # -> Cone, Tip
vector_display_ex = VectorDisplayEx(Point=divide_curve_2.Points, Vector=vector_2pt.Vector, Colour=colour_swatch_3, Width=Slider(0.5, range=0..1))
custom_preview = CustomPreview(Geometry=sphere, Material=colour_swatch_3)
custom_preview_lineweights = CustomPreviewLineweights(Geometry=circle, Shader=colour_swatch_3, Thickness=number_slider_9, Absolute=boolean_toggle)
custom_preview_lineweights_2 = CustomPreviewLineweights(Geometry=line, Shader=colour_swatch_3, Thickness=number_slider_9, Absolute=boolean_toggle)
custom_preview_2 = CustomPreview(Geometry=cone.Cone, Material=colour_swatch_3)

vector_xyz_2 = VectorXYZ(XComponent=0, YComponent=addition, ZComponent=unit_z_3)  # -> Vector, Length

read_file = ReadFile(File=panel_4, PerLineParse=True)
list_item_7 = ListItem(List=read_file, Index=list_item, Wrap=True)
text_split = TextSplit(Text=list_item_7, Separators=",")
cull_index = CullIndex(List=text_split, Indices=Slider(0, range=0..100), Wrap=True)
partition_list = PartitionList(List=cull_index, Size="3")
list_item_8 = ListItem(List=partition_list, Index=0, Wrap=True)  # -> Item, Item1, Item2
construct_point_2 = ConstructPoint(XCoordinate=list_item_8.Item, YCoordinate=list_item_8.Item1, ZCoordinate=list_item_8.Item2)  # -> flatten(Point)
cull_duplicates = CullDuplicates(Points=construct_point_2, Tolerance="0.1", CullMode=3)  # -> Points, Indices, Valence
rotate_2 = Rotate(Geometry=cull_duplicates.Points, Angle=radians_3, Plane=xz_plane_2)  # -> Geometry, Transform

rotate_3 = Rotate(Geometry=rotate_2.Geometry, Angle=radians_4, Plane=yz_plane_2)  # -> Geometry, Transform

list_item_9 = ListItem(List=flatten(pcimportobj_4), Index=list_item, Wrap=True)

rotate_4 = Rotate(Geometry=list_item_9, Angle=radians, Plane=xz_plane)  # -> Geometry, Transform
rotate_5 = Rotate(Geometry=rotate_4.Geometry, Angle=radians_2, Plane=yz_plane)  # -> Geometry, Transform
area_3 = Area(Geometry=rotate_5.Geometry)  # -> Area, Centroid
deconstruct_3 = Deconstruct(Point=area_3.Centroid)  # -> XComponent, YComponent, ZComponent
subtraction = Subtraction(A=deconstruct_3.XComponent, B=negative_4)
subtraction_2 = Subtraction(A=negative_3, B=deconstruct_3.YComponent)
subtraction_3 = Subtraction(A=deconstruct_3.ZComponent, B=Slider(0, range=0..10))
vector_xyz_3 = VectorXYZ(XComponent=subtraction, YComponent=subtraction_2, ZComponent=subtraction_3)  # -> Vector, Length
move_3 = Move(Geometry=rotate_5.Geometry, Motion=vector_xyz_3.Vector)  # -> Geometry, Transform

# ----
# Morphology Generate
move_4 = Move(Geometry=orient_2.Geometry, Motion=vector_xyz_2.Vector)  # -> Geometry, Transform

scale_2 = Scale(Geometry=move_4.Geometry, Center=point, Factor=Slider(0.4, range=0..1))  # -> Geometry, Transform

plan_evolutionary = Python3Script(
    pos_push=flatten(evaluate_curve.Point),
    path_push=flatten(geometry_2),
    vec_front=evaluate_curve.Tangent,
    obstacle=scale_2.Geometry,
    Base_Curve=geometry,
    C_target=point,
    reset=Button())  # -> ellipse_push, ellipse_pull, ellipse_op, Out_Center, Out_Points, Out_Fields, Out_Curve, Out_Vectors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; inputs pos_push: list of Point3d, path_push: list of Curve, pos_pull: list, path_pull: list, pos_op: list, path_op: list, obstacle: Curve, Base_Curve: Curve, C_target: Point3d
# ---------- plan_evolutionary: Python ----------
import Rhino.Geometry as rg
import math
import traceback
import time 

# ==========================================
# ⚙️ 参数控制台 (Top Parameters)
# ==========================================
if 'CP_Count' not in globals() or CP_Count is None: CP_Count = 40
if 'Smooth_Iterations' not in globals() or Smooth_Iterations is None: Smooth_Iterations = 10
if 'Smooth_Tension' not in globals() or Smooth_Tension is None: Smooth_Tension = 0.5
if 'Min_Radius' not in globals() or Min_Radius is None: R_core = 1.0
else: R_core = Min_Radius

# 🏹 向量场控制 (前长后短)
V_Front = 2.0  # 正前方最长向量的长度
V_Back = 0.2   # 正后方最短向量的长度

# 🏃 动态小人参数 (Push/Pull/Operator)
morph_power = 2.5; r_end = 0.5
A_normal = 1.8; D_normal = 1.5; b_normal = 0.8; a_normal = D_normal * 0.5
A_op = 1.2; D_op = 1.8; b_op = 1.2; a_op = D_op * 0.5

# ==========================================
# 🛠️ 工具箱 (Functions)
# ==========================================
def get_dynamic_ellipse(pos, crv, a_radius, b_radius, debug_info=None):
    try:
        if not crv: 
            if debug_info is not None: debug_info['reason'] = "曲线为 None"
            return None
        
        ok, t_param = crv.ClosestPoint(pos)
        if not ok: 
            if debug_info is not None: debug_info['reason'] = "ClosestPoint 失败"
            return None
        
        flat_pos = rg.Point3d(pos.X, pos.Y, pos.Z)
        dom = crv.Domain
        ratio = max(0.0, min(1.0, (t_param - dom.T0) / dom.Length)) if dom.Length > 1e-6 else 0.0
        progress = math.pow(ratio, morph_power)
        a_dyn = a_radius + (r_end - a_radius) * progress
        b_dyn = b_radius + (r_end - b_radius) * progress
        
        t_vec = crv.TangentAt(t_param)
        t_vec.Z = 0
        if t_vec.Length < 1e-5: t_vec = rg.Vector3d(1,0,0)
        else: t_vec.Unitize()
        
        plane = rg.Plane(flat_pos, t_vec, rg.Vector3d(-t_vec.Y, t_vec.X, 0))
        ell_curve = rg.Ellipse(plane, a_dyn, b_dyn).ToNurbsCurve()
        
        if debug_info is not None:
            debug_info['success'] = True
            debug_info['t_param'] = t_param
            debug_info['ratio'] = ratio
            debug_info['a_dyn'] = a_dyn
            debug_info['b_dyn'] = b_dyn
        
        return ell_curve
    except Exception as e:
        if debug_info is not None: debug_info['reason'] = str(e)
        return None

# ==========================================
# ⚡ 状态监控 (Reset Logic)
# ==========================================
current_time = time.strftime("%H:%M:%S")
debug_log = "=" * 60 + "\n"
debug_log += "🕒 运行时间: {}\n".format(current_time)
debug_log += "=" * 60 + "\n"

if "_reset" in globals() and _reset:
    if 'Historical_Max' in globals():
        del globals()['Historical_Max']
    debug_log += "💥 [状态] 历史记忆已清空！\n\n"

# ==========================================
# 🚀 算法主执行区
# ==========================================
Out_Curve = None
Out_Points = []
Out_Center = None
Out_Fields = []
Out_Push_Field = []
Out_Pull_Field = []
Out_Rays = []
Out_Vectors = [] # 新增：渐变长度向量输出

try:
    if 'Historical_Max' not in globals():
        globals()['Historical_Max'] = 1.0
        
    valid_ellipses = []
    
    # ------------------------------------------
    # 【车间 1】: 动态椭圆场生成
    # ------------------------------------------
    if 'pos_push' in globals() and pos_push and 'path_push' in globals() and path_push:
        for idx, (p, crv) in enumerate(zip(pos_push, path_push)):
            if crv is None: continue
            ell = get_dynamic_ellipse(p, crv, a_normal, b_normal)
            if ell:
                valid_ellipses.append(ell)
                Out_Push_Field.append(ell)
                
    if 'pos_pull' in globals() and pos_pull and 'path_pull' in globals() and path_pull:
        for idx, (p, crv) in enumerate(zip(pos_pull, path_pull)):
            if crv is None: continue
            ell = get_dynamic_ellipse(p, crv, a_normal, b_normal)
            if ell:
                valid_ellipses.append(ell)
                Out_Pull_Field.append(ell)
                
    if 'pos_op' in globals() and pos_op and 'path_op' in globals() and path_op:
        for idx, (p, crv) in enumerate(zip(pos_op, path_op)):
            if crv is None: continue
            ell = get_dynamic_ellipse(p, crv, a_op, b_op)
            if ell:
                valid_ellipses.append(ell)
                
    Out_Fields = valid_ellipses

    # ------------------------------------------
    # 【车间 2】: 动态雷达中心
    # ------------------------------------------
    Out_Center = C_target
    if valid_ellipses:
        total_dist = sum(ell.GetBoundingBox(True).Center.DistanceTo(C_target) for ell in valid_ellipses)
        if total_dist > globals()['Historical_Max']:
            globals()['Historical_Max'] = total_dist
        factor_C = 1.0 - (total_dist / globals()['Historical_Max'] * 0.8)
    else:
        factor_C = 1.0

    # ------------------------------------------
    # 【车间 3】: 射线探测
    # ------------------------------------------
    pts_data = [] 
    if 'Base_Curve' in globals() and Base_Curve is not None:
        p_start = Base_Curve.PointAtStart
        p_end = Base_Curve.PointAtEnd
        t_params = Base_Curve.DivideByCount(CP_Count - 1, True)
        
        for t_param in t_params:
            hit_pt = Base_Curve.PointAt(t_param)
            base_dist = C_target.DistanceTo(hit_pt)
            
            dir_vec = hit_pt - C_target
            dir_vec.Z = 0
            if dir_vec.Length > 1e-5: dir_vec.Unitize()
            else: dir_vec = rg.Vector3d(1,0,0)
                
            ray_line = rg.Line(C_target, C_target + dir_vec * 1000).ToNurbsCurve()
            best_dist = R_core * factor_C 
            
            is_anchor = False
            if hit_pt.DistanceTo(p_start) < 0.1 or hit_pt.DistanceTo(p_end) < 0.1:
                best_dist = base_dist
                is_anchor = True

            for ell in valid_ellipses:
                events = rg.Intersect.Intersection.CurveCurve(ray_line, ell, 0.001, 0.001)
                if events:
                    for ev in events:
                        d = C_target.DistanceTo(ev.PointA)
                        if d > best_dist + 0.01: 
                            best_dist = d
                            is_anchor = True
            
            final_pt = C_target + dir_vec * best_dist
            pts_data.append([final_pt, is_anchor, t_param])
            Out_Rays.append(ray_line)

    # ------------------------------------------
    # 【车间 3.1】: 基因排序与提前焊接
    # ------------------------------------------
    if len(pts_data) > 1:
        pts_data.sort(key=lambda item: item[2])
        pts_data[0][0] = Base_Curve.PointAtStart
        pts_data[0][1] = True 
        pts_data[-1][0] = Base_Curve.PointAtEnd
        pts_data[-1][1] = True

    # ------------------------------------------
    # 【车间 4】: 悬索桥平滑
    # ------------------------------------------
    n_pts = len(pts_data)
    for iteration in range(Smooth_Iterations):
        new_data = []
        for i in range(n_pts):
            curr_pt, is_anchor, t_val = pts_data[i]
            if is_anchor: 
                new_data.append([curr_pt, True, t_val])
                continue
            prev_pt = pts_data[i - 1][0]
            next_pt = pts_data[(i + 1) % n_pts][0]
            mid_p = (prev_pt + next_pt) / 2.0
            smoothed_pt = curr_pt + (mid_p - curr_pt) * Smooth_Tension
            new_data.append([smoothed_pt, False, t_val])
        pts_data = new_data

    # ------------------------------------------
    # 【车间 5】: 提取曲线
    # ------------------------------------------
    Out_Points = [d[0] for d in pts_data]
    if len(Out_Points) > 1:
        Out_Curve = rg.Curve.CreateInterpolatedCurve(Out_Points, 3)

    # ------------------------------------------
    # 🌟【车间 6】: 正前方向量长度渐变场 (Dot Product)
    # ------------------------------------------
    if 'vec_front' in globals() and vec_front is not None:
        v_f = rg.Vector3d(vec_front.X, vec_front.Y, 0)
        if v_f.Length > 1e-5: 
            v_f.Unitize()
            for pt in Out_Points:
                dir_out = pt - C_target
                dir_out.Z = 0
                if dir_out.Length > 1e-5:
                    dir_out.Unitize()
                    
                    # 1. 计算点乘，范围在 [-1, 1] 之间
                    dot_val = dir_out.X * v_f.X + dir_out.Y * v_f.Y
                    
                    # 2. 将 [-1, 1] 的值映射到 [V_Back, V_Front] 的真实长度
                    mapped_len = V_Back + (dot_val + 1.0) / 2.0 * (V_Front - V_Back)
                    
                    # 3. 在原点处生成带有特定长度的线段表示向量
                    vec_line = rg.Line(pt, pt + dir_out * mapped_len).ToNurbsCurve()
                    Out_Vectors.append(vec_line)
        debug_log += f"✅ 生成 {len(Out_Vectors)} 根渐变长度向量\n"
    else:
        debug_log += f"⚠️ 未接入 vec_front，跳过渐变向量生成\n"

except Exception as e:
    error_msg = "❌ 致命错误: " + str(e)
    debug_log += "\n" + error_msg + "\n"
    debug_log += traceback.format_exc()
    print(traceback.format_exc())

debug = debug_log
# ---------- end plan_evolutionary ----------

panel_14 = Panel("""0.04
0.1""")
panel_15 = Panel("""0.02
0.04""")
dash_pattern = DashPattern(Curve=geometry_2, Pattern=panel_15)  # -> flatten(Dashes), Gaps
python_3_script_3 = Python3Script(Toggle=Toggle(False))  # -> val_float, val_int
# ---------- python_3_script_3: Python ----------
# -*- coding: utf-8 -*-
"""
【双轨同频自动动画发生器 ── Boolean Toggle 开关控制版】
核心机制：
  1. 🎛️【开关自锁】：完美匹配 Grasshopper 的 Boolean Toggle 组件。
     - Toggle = True：开启充气，慢速从 0% 丝滑滚动到 100%。
     - Toggle = False：随时强行断电、瞬间重置复位（输出 0.0 和 1）。
  2. 🔌【双通道纯净输出】：val_float (0.0->1.2) 和 val_int (1->100)。
"""

import scriptcontext as sc
import Grasshopper as gh
import math

# ==========================================
# ⚙️ 动画速率控制台
# ==========================================
Animation_Speed = 0.1  # 慢速丝滑步长

# ==========================================
# 🧠 Sticky 全局内存管理
# ==========================================
if "anim_t" not in sc.sticky:
    sc.sticky["anim_t"] = 0.0

# ==========================================
# 🎛️ 开关核心拦截状态机
# ==========================================
is_running = False

# 安全检查：确保外界连了 Toggle 端口
if "Toggle" in globals() and Toggle is not None:
    if not Toggle:
        # 🔴 开关为 False：处于重置断电状态，进度死死锁在 0.0
        sc.sticky["anim_t"] = 0.0
        is_running = False
    else:
        # 🟢 开关为 True：允许播放，但如果冲到 1.0 终点就锁死停止
        if sc.sticky["anim_t"] < 1.0:
            is_running = True
        else:
            is_running = False

# ==========================================
# 🔄 动画自刷新核心引擎
# ==========================================
if is_running:
    # 慢速递增进度
    sc.sticky["anim_t"] += Animation_Speed
    if sc.sticky["anim_t"] >= 1.0:
        sc.sticky["anim_t"] = 1.0
    
    # 排定下一次 Grasshopper 画布更新日程
    def Callback(doc):
        ghenv.Component.ExpireSolution(False)
        
    gh_doc = ghenv.Component.OnPingDocument()
    if gh_doc:
        gh_doc.ScheduleSolution(1, gh.Kernel.GH_Document.GH_ScheduleDelegate(Callback))

# ==========================================
# 📐 数据线性映射
# ==========================================
current_t = sc.sticky["anim_t"]

# 轨 1：0.0 ──> 1.2 的慢速浮点数
v_float = 0.0 + (1 - 0.0) * current_t
v_float = round(v_float, 4)  

# 轨 2：1 ──> 100 的慢速整数
v_int = 1.0 + (100.0 - 1.0) * current_t
v_int = int(round(v_int))     

# ==========================================
# 📤 双通道纯净数字端口输出
# ==========================================
val_float = v_float    # 端口一：0.0 到 1.2
val_int = v_int        # 端口二：1 到 100
# ---------- end python_3_script_3 ----------
number_slider_12 = Slider(0.005, range=0..0.1)
boolean_toggle_2 = BooleanToggle(True)
colour_swatch_4 = ColourSwatch(SwatchColor=RGB(0, 43, 255))
colour_swatch_5 = ColourSwatch(SwatchColor=RGB(0, 43, 255))
deconstruct_plane = DeconstructPlane(Plane=horizontal_frame_2)  # -> Origin, XAxis, YAxis, ZAxis
vector_display_ex_2 = VectorDisplayEx(Point=horizontal_frame_2, Vector=deconstruct_plane.XAxis, Colour=colour_swatch_5, Width=2)
custom_preview_lineweights_3 = CustomPreviewLineweights(Geometry=dash_pattern.Dashes, Shader=colour_swatch_4, Thickness=Slider(0.015, range=0..1), Absolute=boolean_toggle_2)
custom_preview_lineweights_4 = CustomPreviewLineweights(Geometry=dash_pattern.Dashes, Shader=colour_swatch_4, Thickness=Slider(0.005, range=0..1), Absolute=boolean_toggle_2)
custom_preview_lineweights_5 = CustomPreviewLineweights(Geometry=orient_2.Geometry, Shader=colour_swatch_5, Thickness=Slider(0.008, range=0..0.1), Absolute=boolean_toggle_2)

panel_16 = Panel(python_3_script_3.val_float)

pick_n_choose = PickNChoose(Pattern=python_3_script.action_id_list, Stream0=move_3.Geometry, Stream1=move.Geometry)

vector = Vector(vector_xyz_3.Vector)
move_5 = Move(Geometry=rotate_3.Geometry, Motion=vector)  # -> Geometry, Transform

rotate_6 = Rotate(Geometry=move_5.Geometry, Angle=radians_5, Plane=yz_plane_3)  # -> Geometry, Transform

move_6 = Move(Geometry=rotate_6.Geometry, Motion=unit_z)  # -> Geometry, Transform

merge_3 = Merge(Data1=move_3.Geometry, Data2=move_6.Geometry)

orient_3 = Orient(Geometry=graft(merge_3), Source=PlaneXY(0, 0, 0), Target=geometry_3)  # -> Geometry, Transform

list_item_10 = ListItem(List=flatten(orient_3.Geometry), Index=number_slider_4, Wrap=True)
cull_index_2 = CullIndex(List=flatten(orient_3.Geometry), Indices=number_slider_4, Wrap=True)
move_7 = Move(Geometry=list_item_10, Motion=unit_y)  # -> Geometry, Transform

custom_preview_3 = CustomPreview(Geometry=move_7.Geometry, Material="金属")

python_3_script_4 = Python3Script(Pts_Curr=cull_index_2, Base_Curve=move_4.Geometry, Morph_Factor=number_slider_10)  # -> Push_Rays, Out_Ellipses, Out_Curves, Out_Rays, Push_Rays_2, debug_geometry, Skeleton_Lines, Influence_Spheres, peak_indices, peak_points; inputs Pts_Curr: list of Point3d, Base_Curve: Curve
# ---------- python_3_script_4: Python ----------
# -*- coding: utf-8 -*-
"""
[Component 1: Adaptive Airbag Generator ── Intelligent Ergonomics Ultimate Edition (with Cross-Coordinate Transmission & Dynamic Morph Engine)]
[Revision: Inward Contraction Mode - From Maximum Sphere → Inward Pull to Fit Body]

Core Mechanisms:
  1. 🧘‍♂️ [Locally Autonomous Driven Boundary]: All intersections/joints of limbs and torso have their deformation controlled in real-time completely by local PUSH/PULL.
  2. 🔄 [Reverse Pulling]: All rays are changed to contract inward rather than expand outward.
  3. 🦋 [New: Dynamic Morph Engine (Lerp)]: Controls contraction intensity in real-time via Morph_Factor (0.0 - 1.0).
  4. 🔌 [Full Output on 9 Main Ports]: Push_Rays, Out_Ellipses, Out_Curves, Out_Rays, debug_geometry, Skeleton_Lines, Influence_Spheres, peak_points, peak_indices.
"""

import Rhino.Geometry as rg
from Rhino.Geometry import CurveKnotStyle
import scriptcontext as sc
import math
import traceback
import Grasshopper
from Grasshopper.Kernel.Data import GH_Path

# ==========================================
# ⚙️ Global Dynamic Console (High Smoothing Configuration)
# ==========================================
CP_Count = 40          # Boundary sampling points
Smooth_Iterations = 8    # "Ironing" smoothing iterations
Smooth_Tension = 0.1     # Fabric tension

Global_Padding = 0.01    # Global ultra-gentle contraction value (Unit: meters) [Revision: from 0.15 -> 0.01]

# 🌟 [Base Geometric Characteristics for Each Part]: Strictly read the push (push_r) and pull (pull_gap) genes of each part
Somatic_Matrix = {
    3:   {"name": "HEAD",     "push_r": 0.5, "pull_gap": 0.07},  
    6:   {"name": "L_HAND",   "push_r": 0.5, "pull_gap": 0.03},  
    10:  {"name": "R_HAND",   "push_r": 0.5, "pull_gap": 0.03},  
    7:   {"name": "UP_BACK",  "push_r": 0.35, "pull_gap": 0.08},  
    0:   {"name": "LOW_BACK", "push_r": 0.60, "pull_gap": 0.10},  
    12:  {"name": "L_KNEE",   "push_r": 0.20, "pull_gap": 0.05},  
    16:  {"name": "R_KNEE",   "push_r": 0.20, "pull_gap": 0.05},
    14:  {"name": "L_TOE",    "push_r": 0.18, "pull_gap": 0.05},  
    18:  {"name": "R_TOE",    "push_r": 0.18, "pull_gap": 0.05}   
}

# 🚀 Top-level structural topology network
bone_pairs = [
    (0, 1), (1, 2), (2, 7), (7, 3),       # Spine to Head
    (7, 4), (4, 5), (5, 6),               # Left Arm
    (7, 8), (8, 9), (9, 10),              # Right Arm
    (0, 11), (11, 12), (12, 13), (13, 14), # Left Leg
    (0, 15), (15, 16), (16, 17), (17, 18)  # Right Leg
]

# ==========================================
# 🦋 Animation Factor Safety Check
# ==========================================
try:
    morph_val = float(Morph_Factor)
except:
    morph_val = 1.0  # Default to final state
# Restrict between 0.0 and 1.0
morph_val = max(0.0, min(1.0, morph_val))

# ==========================================
# 🚀 Port Data Tree Initialization
# ==========================================
Push_Rays = Grasshopper.DataTree[object]()
Out_Ellipses = Grasshopper.DataTree[object]() 
Out_Curves = Grasshopper.DataTree[object]()
Out_Rays = Grasshopper.DataTree[object]()
debug_geometry = Grasshopper.DataTree[object]()
Skeleton_Lines = [] 
Influence_Spheres = Grasshopper.DataTree[object]()
peak_points = Grasshopper.DataTree[object]()
peak_indices = Grasshopper.DataTree[object]()

try:
    if Base_Curve and Pts_Curr and len(Pts_Curr) > 18:
        # Get the center information of Base_Curve (for subsequent translation reference)
        base_curve_bbox = Base_Curve.GetBoundingBox(True)
        base_center = base_curve_bbox.Center
        base_center_xy = rg.Point3d(base_center.X, base_center.Y, 0)  # XY plane projection
        
        # Extract panoramic absolute chest normal vector
        vec_spine = Pts_Curr[7] - Pts_Curr[0]       
        vec_shoulder = Pts_Curr[4] - Pts_Curr[8]          
        vec_spine.Unitize()
        vec_shoulder.Unitize()
        vec_front = rg.Vector3d.CrossProduct(vec_shoulder, vec_spine)
        vec_front.Unitize()
        
        # Construct 3D rigid skeleton line segment network
        skeleton_bones = []
        for p1_idx, p2_idx in bone_pairs:
            bone_line = rg.Line(Pts_Curr[p1_idx], Pts_Curr[p2_idx])
            skeleton_bones.append(bone_line)
            Skeleton_Lines.append(rg.LineCurve(bone_line))
        
        # 🌟 Get the spine height range (used for spherical scaling)
        all_z_values = [pt.Z for pt in Pts_Curr]
        min_z = min(all_z_values)
        max_z = max(all_z_values)
        z_range = max_z - min_z if max_z > min_z else 1.0
        
        # ======= Layer-by-Layer Deformation: Adaptive Morphogenetic Generator =======
        for i, (pt_id, attr) in enumerate(Somatic_Matrix.items()):
            path = GH_Path(i)
            push_r = attr["push_r"]
            pull_gap = attr["pull_gap"]
            name = attr["name"]
            curr_p = Pts_Curr[pt_id]
            z_height = curr_p.Z 
            
            # Sample directly from Base_Curve to maintain original shape
            layer_base_global = Base_Curve.Duplicate()
            
            # Translate Base_Curve to the height of the current body part
            base_curve_current_center_z = layer_base_global.GetBoundingBox(True).Center.Z
            layer_base_global.Translate(0, 0, z_height - base_curve_current_center_z)
            
            # Get the center point at this height
            C_target = rg.Point3d(base_center_xy.X, base_center_xy.Y, z_height)
            
            # Output original-position reference curve (State 0 visual reference) = Base_Curve itself
            Out_Ellipses.Add(layer_base_global, path)
            
            # Calculate the anatomical local front direction of the current joint layer itself
            curr_bone_dir = rg.Vector3d(0, 0, 1)
            if pt_id in [6, 10, 14, 18]:
                p_idx = {6:5, 10:9, 14:13, 18:17}.get(pt_id, 0)
                curr_bone_dir = curr_p - Pts_Curr[p_idx]
            elif pt_id in [12, 16]:
                curr_bone_dir = Pts_Curr[pt_id+1] - curr_p
            if curr_bone_dir.Length > 1e-5: curr_bone_dir.Unitize()
            
            if name in ["HEAD", "UP_BACK", "LOW_BACK"]:
                curr_local_front = vec_front
            else:
                proj = vec_front - (vec_front * curr_bone_dir) * curr_bone_dir
                curr_local_front = proj if proj.Length > 1e-3 else rg.Vector3d.CrossProduct(vec_shoulder, curr_bone_dir)
                curr_local_front.Unitize()
            
            # ⏳ Collect all emission drivers for this layer
            emission_drivers = []
            emission_drivers.append({"pt": curr_p, "local_front": curr_local_front})
            
            local_slice_plane = rg.Plane(C_target, rg.Vector3d.ZAxis)
            for idx_b, bone in enumerate(skeleton_bones):
                success, t = rg.Intersect.Intersection.LinePlane(bone, local_slice_plane)
                if success and (0.0 <= t <= 1.0):
                    intersect_pt = bone.PointAt(t)
                    
                    is_duplicate = False
                    for existing_drv in emission_drivers:
                        if existing_drv["pt"].DistanceTo(intersect_pt) < 1e-3:
                            is_duplicate = True
                            break
                    if not is_duplicate:
                        b_dir = bone.Direction
                        b_dir.Unitize()
                        p1_idx, p2_idx = bone_pairs[idx_b]
                        is_limb_bone = not (p1_idx in [0, 1, 2] and p2_idx in [1, 2, 7] or p1_idx == 7 and p2_idx == 3)
                        
                        if not is_limb_bone:
                            b_local_front = vec_front
                        else:
                            proj_b = vec_front - (vec_front * b_dir) * b_dir
                            b_local_front = proj_b if proj_b.Length > 1e-3 else rg.Vector3d.CrossProduct(vec_shoulder, b_dir)
                            b_local_front.Unitize()
                            
                        emission_drivers.append({"pt": intersect_pt, "local_front": b_local_front})
                        debug_geometry.Add(intersect_pt, path)
            
            pts_data = []
            t_params = layer_base_global.DivideByCount(CP_Count - 1, True)
            
            # State 0: Point set sampled directly from Base_Curve (maintaining original shape)
            base_points_raw = [layer_base_global.PointAt(t) for t in t_params]
            
            # 🌟 Spherical scaling deformation: larger in the middle, smaller at both ends (but start/end XY remain fixed)
            start_pt = layer_base_global.PointAtStart
            end_pt = layer_base_global.PointAtEnd
            mid_pt_xy = rg.Point3d((start_pt.X + end_pt.X) / 2.0, (start_pt.Y + end_pt.Y) / 2.0, 0)
            
            # Calculate the spherical weight at this height (1.0 in the middle, 0.6 at the ends based on min_weight)
            relative_height = (z_height - min_z) / z_range if z_range > 0 else 0.5
            min_weight = 0.6 # Ends maintain at least 60% of the size
            spherical_weight = min_weight + (1.0 - min_weight) * math.sin(relative_height * math.pi)
            
            # Apply spherical scaling to each sampling point
            for idx in range(len(base_points_raw)):
                pt = base_points_raw[idx]
                # Vector from mid-point to the current point (XY plane)
                vec_from_mid_x = pt.X - mid_pt_xy.X
                vec_from_mid_y = pt.Y - mid_pt_xy.Y
                
                # Scale this vector based on the spherical weight
                scaled_vec_x = vec_from_mid_x * spherical_weight
                scaled_vec_y = vec_from_mid_y * spherical_weight
                
                # New coordinates (Z remains unchanged, start/end XY stay on the line)
                pt_new = rg.Point3d(mid_pt_xy.X + scaled_vec_x, mid_pt_xy.Y + scaled_vec_y, pt.Z)
                base_points_raw[idx] = pt_new
            
            # --- Core Directional Radar Scanning Loop ---
            max_weight = -1.0      
            max_weight_idx = -1    
            
            for idx, t in enumerate(t_params):
                pt_global = base_points_raw[idx] 
                dir_vec = pt_global - C_target
                dir_vec.Z = 0
                
                if idx == 0 or idx == (CP_Count - 1):
                    final_pt = pt_global
                    is_anchor = True
                else:
                    is_anchor = False
                    if dir_vec.Length > 1e-5: dir_vec.Unitize()
                    else: dir_vec = rg.Vector3d(1, 0, 0)
                    
                    front_2d = rg.Vector3d(curr_local_front.X, curr_local_front.Y, 0)
                    if front_2d.Length > 1e-5: front_2d.Unitize()
                    else: front_2d = rg.Vector3d(1, 0, 0)
                    angle = rg.Vector3d.VectorAngle(dir_vec, front_2d)
                    current_ray_weight = math.pow(max(0.0, math.cos(angle)), 2.0)
                    
                    if current_ray_weight > max_weight:
                        max_weight = current_ray_weight
                        max_weight_idx = idx
                    
                    candidate_points = []
                    for driver in emission_drivers:
                        driver_pt = driver["pt"]
                        l_front = driver["local_front"]
                        
                        layer_base_local = layer_base_global.Duplicate()
                        curr_center = layer_base_local.GetBoundingBox(True).Center
                        move_vec = rg.Vector3d(driver_pt.X - curr_center.X, driver_pt.Y - curr_center.Y, 0)
                        layer_base_local.Translate(move_vec)
                        pt_local = layer_base_local.PointAt(t)
                        
                        dir_local = pt_local - driver_pt
                        dir_local.Z = 0
                        if dir_local.Length > 1e-5: dir_local.Unitize()
                        else: dir_local = rg.Vector3d(1, 0, 0)
                        
                        l_front_2d = rg.Vector3d(l_front.X, l_front.Y, 0)
                        if l_front_2d.Length > 1e-5: l_front_2d.Unitize()
                        else: l_front_2d = rg.Vector3d(vec_front.X, vec_front.Y, 0)
                        
                        dot_local = dir_local.X * l_front_2d.X + dir_local.Y * l_front_2d.Y
                        is_push_ray = (dot_local >= 0)
                        
                        # 🔥 Core Modification: Changed to inward contraction (negative value) + ultra-gentle intensity
                        if is_push_ray:
                            target_dist = -(push_r + Global_Padding) * 0.125
                        else:
                            target_dist = -(pull_gap + Global_Padding) * 0.125
                            
                        pt_teardrop = driver_pt + dir_local * target_dist
                        
                        normalized_t = idx / float(CP_Count - 1)
                        anchor_weight = math.pow(math.sin(normalized_t * math.pi), 0.5) 
                        
                        pt_cand = pt_global + (pt_teardrop - pt_global) * anchor_weight
                        candidate_points.append(pt_cand)
                        
                        ray_geom = rg.LineCurve(driver_pt, pt_cand)
                        if is_push_ray: Push_Rays.Add(ray_geom, path)
                        else: Out_Rays.Add(ray_geom, path)
                    
                    # 👑 Maximum Outer Envelope Inclusion Algorithm (Changed to minimum inner envelope)
                    final_pt = candidate_points[0]
                    max_d = final_pt.DistanceTo(C_target)
                    for p_cand in candidate_points[1:]:
                        d_cand = p_cand.DistanceTo(C_target)
                        if d_cand > max_d:
                            max_d = d_cand
                            final_pt = p_cand
                
                pts_data.append([final_pt, is_anchor])
                
            pts_data[0][0] = layer_base_global.PointAtStart
            pts_data[-1][0] = layer_base_global.PointAtEnd
            
            # --- 30-Point Streamline Ironing Smoothing ---
            n_pts = len(pts_data)
            for _ in range(Smooth_Iterations):
                new_data = []
                for idx in range(n_pts):
                    curr_pt, is_anch = pts_data[idx]
                    if idx == 0 or idx == (n_pts - 1) or is_anch:
                        new_data.append([curr_pt, True])
                        continue
                    prev_pt = pts_data[idx - 1][0]
                    next_pt = pts_data[idx + 1][0] 
                    mid_p = (prev_pt + next_pt) / 2.0
                    smoothed_pt = curr_pt + (mid_p - curr_pt) * Smooth_Tension
                    new_data.append([smoothed_pt, False])
                pts_data = new_data
                
            final_points = [d[0] for d in pts_data] # State 1: Fully morphed point set
            
            if max_weight_idx != -1 and max_weight_idx < len(final_points):
                peak_geom_pt = final_points[max_weight_idx]
                peak_points.Add(rg.Point3d(peak_geom_pt.X, peak_geom_pt.Y, peak_geom_pt.Z), path)
                peak_indices.Add(max_weight_idx, path)
            
            sphere_r = (pull_gap if "BACK" in name else push_r) + Global_Padding
            Influence_Spheres.Add(rg.Sphere(curr_p, sphere_r).ToNurbsSurface(), path)
            
            # 🦋 ==========================================
            # 🌟 Core Injection: 0-1 Dynamic Morph Linear Interpolation (Lerp)
            # morph_val = 0.0 → Base_Curve original state (maximum)
            # morph_val = 1.0 → Full inward contraction (minimum)
            # ==========================================
            morphed_points = []
            for idx_pt in range(len(final_points)):
                pt_0 = base_points_raw[idx_pt]  # State 0: Base_Curve points (Original Maximum)
                pt_1 = final_points[idx_pt]     # State 1: Final points after inward pulling and smoothing
                
                # Vector interpolation calculation: current point = start point + (end point vector - start point vector) * morph factor
                pt_m = pt_0 + (pt_1 - pt_0) * morph_val
                morphed_points.append(pt_m)

            # Finally generate the curve using the blended (Morphed) vertices!
            # Use Clamped to keep it open (non-periodic)
            try:
                knot_style = CurveKnotStyle(1)  # 1 = Clamped
                interpolated_curve = rg.Curve.CreateInterpolatedCurve(morphed_points, 3, knot_style)
                if interpolated_curve:
                    Out_Curves.Add(interpolated_curve, path)
            except Exception as e:
                print(f"⚠️ Curve generation failed ({name}): {str(e)}")
            
        print("🎉 [Ergonomic Ultimate Edition] Inward contraction engine mounted! Current contraction progress: {:.1f}%".format(morph_val * 100))

except Exception as e:
    print("❌ Execution failed: " + str(e))
    print(traceback.format_exc())

# --- 📤
# ---------- end python_3_script_4 ----------
python_3_script_5 = Python3Script(
    In_Curves=python_3_script_4.Out_Curves,
    In_Rays=python_3_script_4.Out_Rays,
    Box_Top_Crv=list_item_5,
    Box_Bottom_Crv=list_item_6,
    Peak_Indices=python_3_script_4.peak_indices,
    Morph_Factor=number_slider_10)  # -> rib_lines, rib_points, deformed_top_curve, deformed_btm_curve, a_top, a_bottom, warped_curves, debug_points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; inputs In_Curves: tree of Curve, In_Rays: tree of Curve, Box_Top_Crv: Curve, Box_Bottom_Crv: Curve, Peak_Indices: tree
# ---------- python_3_script_5: Python ----------
# -*- coding: utf-8 -*-
"""
[Component 2: Adaptive Full-Cabin Assembly Plant ── Pole End Anchorage Repair Edition + Morph_Factor Control]
Modification Notes:
  - ✂️ [Reject Redundant Arcs]: Completely cleared the 28 redundant intermediate arcs from rendering.
  - ⭕ [rib_lines Port]: Now 100% outputs only the [two precise rigid small arcs] at the left and right pole seams.
  - 🌟 [Bug Fix]: Fixed the abnormal narrowing issue at both ends of the Top Cap and Bottom Cap. Forced the closure endpoints of the top and bottom caps to lock onto the Box boundary, ensuring smooth lofting without wrinkles!
  - 🦋 [Morph Blending]: The head and foot caps are now controlled by Morph_Factor, smoothly inflating from the "Box Boundary Initial State" to the "Fully Inflated State".
"""

import Rhino.Geometry as rg
import Grasshopper
from Grasshopper.Kernel.Data import GH_Path
import math
import traceback

# --- 📦 0. Initialize Final Output Containers ---
warped_curves = Grasshopper.DataTree[object]()
rib_lines = []              
deformed_top_curve = None  
deformed_btm_curve = None  
neutral_curve = None       
neutral_plane_circle = None  
rib_points = Grasshopper.DataTree[object]()  
highlighted_ribs = Grasshopper.DataTree[object]()  
adjusted_top_pts = None
adjusted_btm_pts = None
move_vector = None  # 🌟 [New] Push vector
out_msg = "Pole boundary dual-arc precise interception assembly line running..."

# 🛠️ [3D Geometric Point and Curve Diagnostic Pipeline]
debug_pts_geom = []          
z_safe_geom = []             
delta_z_geom = []             
sorted_raw_curves_geom = []  

# 🦋 Morph_Factor Safety Check
try:
    morph_val = float(Morph_Factor)
except:
    morph_val = 1.0
morph_val = max(0.0, min(1.0, morph_val))

def get_pts(crv, count):
    if crv is None: return None
    params = crv.DivideByCount(count - 1, True)
    return [crv.PointAt(t) for t in params]

def safe_create_curve(pts):
    cleaned = []
    for p in pts:
        if not cleaned or p.DistanceTo(cleaned[-1]) > 0.0001:
            cleaned.append(p)
    if len(cleaned) < 2: return None
    crv = rg.Curve.CreateInterpolatedCurve(cleaned, 3)
    return crv if crv else rg.PolylineCurve(cleaned)

try:
    if In_Curves is None or Box_Top_Crv is None or Box_Bottom_Crv is None:
        out_msg = "⏳ Waiting for In_Curves, Box_Top_Crv, Box_Bottom_Crv to be fully connected and loaded..."
    else:
        # ==========================================
        # 🧱 1. Space Hierarchy Alignment and Grand Circular Cabin Central Axis Establishment
        # ==========================================
        raw_curves = []
        for path in In_Curves.Paths:
            for crv in In_Curves.Branch(path):
                if crv: raw_curves.append(crv)
        
        raw_curves.sort(key=lambda c: c.PointAtStart.Z, reverse=True)
        num_layers = len(raw_curves)
        
        if num_layers == 0:
            out_msg = "🚨 Error: No valid curves captured inside the data tree!"
        else:
            sorted_raw_curves_geom = list(raw_curves)
            mid_idx = num_layers // 2
            neutral_curve = raw_curves[mid_idx]
            
            # 🔍 DEBUG: Print start and end endpoint heights for each curve in raw_curves
            print("="*80)
            print("🔍 [DEBUG] Start and end endpoint heights for each curve in raw_curves:")
            for idx in [0, 1, -2, -1]:
                crv = raw_curves[idx]
                print(f"\nraw_curves[{idx}]:")
                print(f"   PointAtStart.Z = {crv.PointAtStart.Z:.4f}")
                print(f"   PointAtEnd.Z   = {crv.PointAtEnd.Z:.4f}")
            print("="*80)
            
            master_count = 30
            box_top_pts = get_pts(Box_Top_Crv, master_count)
            box_btm_pts = get_pts(Box_Bottom_Crv, master_count)
            
            if box_top_pts[0].DistanceTo(raw_curves[0].PointAtStart) > box_top_pts[-1].DistanceTo(raw_curves[0].PointAtStart):
                box_top_pts.reverse()
            if box_btm_pts[0].DistanceTo(raw_curves[-1].PointAtStart) > box_btm_pts[-1].DistanceTo(raw_curves[-1].PointAtStart):
                box_btm_pts.reverse()

            z_neutral = (box_top_pts[0].Z + box_btm_pts[0].Z) * 0.5

            # 🛠️ Extract grand circular cabin projection control parameters
            cabin_center_x = sum(p.X for p in box_top_pts) / len(box_top_pts)
            cabin_center_y = sum(p.Y for p in box_top_pts) / len(box_top_pts)
            cabin_center_xy = rg.Point3d(cabin_center_x, cabin_center_y, 0)
            ref_radius = cabin_center_xy.DistanceTo(rg.Point3d(box_top_pts[0].X, box_top_pts[0].Y, 0))

            circle_obj = rg.Circle(rg.Point3d(cabin_center_x, cabin_center_y, z_neutral), ref_radius * 1.1)  
            neutral_plane_circle = circle_obj.ToNurbsCurve()

            # ==========================================
            # 🧱 2. Posture-Adaptive Dome Height Equalization
            # ==========================================
            all_z_values = [crv.PointAtStart.Z for crv in raw_curves]
            z_max_body = max(all_z_values)
            z_min_body = min(all_z_values)
            current_body_height = z_max_body - z_min_body
            
            factor_posture = current_body_height / 1.75
            factor_posture = min(1.3, max(0.4, factor_posture))
            dynamic_top_offset = 0.4 * factor_posture
            dynamic_btm_offset = 0.3 * factor_posture
            
            total_layer_count = num_layers + 2

            # 🌟 Push box points along the cabin plane normal vector based on morph_val to compensate for volume
            push_offset = 0.6  # Push distance (for larger effect)
            
            # Calculate the normal vector of the cabin plane (defining the plane with the first three box_top_pts)
            p1 = box_top_pts[0]
            p2 = box_top_pts[1]
            p3 = box_top_pts[2]
            
            v1 = rg.Vector3d(p2.X - p1.X, p2.Y - p1.Y, p2.Z - p1.Z)
            v2 = rg.Vector3d(p3.X - p1.X, p3.Y - p1.Y, p3.Z - p1.Z)
            
            # Calculate normal vector (cross product)
            plane_normal = rg.Vector3d.CrossProduct(v1, v2)
            plane_normal.Unitize()
            
            # 🌟 [New] Calculate push vector (for outputting to other geometries)
            move_vector = plane_normal * push_offset * morph_val
            
            # Calculate pushed top points
            adjusted_box_top_pts = []
            for i in range(master_count):
                # Push outward along the plane normal vector
                adjusted_pt = box_top_pts[i] + plane_normal * push_offset * morph_val
                adjusted_box_top_pts.append(adjusted_pt)
            
            # Calculate pushed bottom points
            adjusted_box_btm_pts = []
            for i in range(master_count):
                # Push outward along the plane normal vector
                adjusted_pt = box_btm_pts[i] + plane_normal * push_offset * morph_val
                adjusted_box_btm_pts.append(adjusted_pt)
            
            # Save to global variables for output
            adjusted_top_pts = adjusted_box_top_pts
            adjusted_btm_pts = adjusted_box_btm_pts
            all_final_pts_matrix = [None] * total_layer_count

            # 🌟 Pre-sample points of the highest and lowest curves to use as references for the initial state
            raw_curves_top_pts = get_pts(raw_curves[0], master_count)
            raw_curves_btm_pts = get_pts(raw_curves[-1], master_count)
            
            # ==========================================
            # 🧱 3. Weaving Generation: Head Top-Level Control Surface (Matrix[0]) -> 🦋 [Morph Blending - Option B]
            # ==========================================
            top_layout_pts = get_pts(raw_curves[0], master_count)
            
            # 🌟 Initial State: Use smaller inflation (still has a head when morph_val=0, but more gentle)
            top_cap_pts_initial = []
            initial_offset_factor = 0.3  # Initial state has only 30% inflation intensity
            for i in range(master_count):
                dist_from_center = abs(i - 14.5) / 14.5
                weight = math.cos(dist_from_center * math.pi / 2.0)
                
                if i == 0:
                    z_cap_initial = adjusted_box_top_pts[0].Z
                elif i == (master_count - 1):
                    z_cap_initial = adjusted_box_top_pts[-1].Z
                else:
                    # Use inflation logic in the middle, smooth transition when approaching the start and end
                    dist_from_edge = min(i, master_count - 1 - i)
                    edge_factor = max(0, min(1.0, (dist_from_edge - 1) / 2))
                    z_inflated = z_max_body + weight * (dynamic_top_offset * initial_offset_factor)
                    z_cap_initial = z_inflated * edge_factor + adjusted_box_top_pts[i].Z * (1.0 - edge_factor)
                
                if i == 0:
                    top_cap_pts_initial.append(rg.Point3d(adjusted_box_top_pts[0].X, adjusted_box_top_pts[0].Y, z_cap_initial))
                elif i == (master_count - 1):
                    top_cap_pts_initial.append(rg.Point3d(adjusted_box_top_pts[-1].X, adjusted_box_top_pts[-1].Y, z_cap_initial))
                else:
                    top_cap_pts_initial.append(rg.Point3d(top_layout_pts[i].X, top_layout_pts[i].Y, z_cap_initial))
            
            # 🌟 Inflated State: Original calculation method (full inflation)
            top_cap_pts_final = []
            for i in range(master_count):
                dist_from_center = abs(i - 14.5) / 14.5
                weight = math.cos(dist_from_center * math.pi / 2.0)
                
                if i == 0:
                    z_cap_final = adjusted_box_top_pts[0].Z
                elif i == (master_count - 1):
                    z_cap_final = adjusted_box_top_pts[-1].Z
                else:
                    # Use inflation logic in the middle, smooth transition when approaching the start and end
                    dist_from_edge = min(i, master_count - 1 - i)
                    edge_factor = max(0, min(1.0, (dist_from_edge - 1) / 2))
                    z_inflated = z_max_body + weight * dynamic_top_offset
                    z_cap_final = z_inflated * edge_factor + adjusted_box_top_pts[i].Z * (1.0 - edge_factor)
                
                if i == 0:
                    top_cap_pts_final.append(rg.Point3d(adjusted_box_top_pts[0].X, adjusted_box_top_pts[0].Y, z_cap_final))
                elif i == (master_count - 1):
                    top_cap_pts_final.append(rg.Point3d(adjusted_box_top_pts[-1].X, adjusted_box_top_pts[-1].Y, z_cap_final))
                else:
                    top_cap_pts_final.append(rg.Point3d(top_layout_pts[i].X, top_layout_pts[i].Y, z_cap_final))
            
            # 🦋 Morph Interpolation: Initial State -> Inflated State
            top_cap_pts_morphed = []
            for i in range(master_count):
                pt_0 = top_cap_pts_initial[i]
                pt_1 = top_cap_pts_final[i]
                pt_m = pt_0 + (pt_1 - pt_0) * morph_val
                top_cap_pts_morphed.append(pt_m)
            
            # 🔍 DEBUG: Print start and end point heights for head (top_cap_pts)
            print("="*80)
            print("🔍 [DEBUG] Start and end point heights for head (top_cap_pts):")
            print(f"\ninitial state (when morph=0):")
            print(f"   top_cap_pts_initial[0].Z = {top_cap_pts_initial[0].Z:.4f}")
            print(f"   top_cap_pts_initial[-1].Z = {top_cap_pts_initial[-1].Z:.4f}")
            print(f"\nfinal state (when morph=1):")
            print(f"   top_cap_pts_final[0].Z = {top_cap_pts_final[0].Z:.4f}")
            print(f"   top_cap_pts_final[-1].Z = {top_cap_pts_final[-1].Z:.4f}")
            print(f"\nmorphed state (at morph={morph_val:.2f}):")
            print(f"   top_cap_pts_morphed[0].Z = {top_cap_pts_morphed[0].Z:.4f}")
            print(f"   top_cap_pts_morphed[-1].Z = {top_cap_pts_morphed[-1].Z:.4f}")
            print("="*80)
            
            # 🌟 Calculate the spherical weight corresponding to this height (highest layer relative_height = 1.0)
            min_weight_spherical = 0.6  # From 0.45 -> 0.6 (shape won't be too small when morph=0)
            relative_height_top = 1.0  # Highest layer
            spherical_weight_top = min_weight_spherical + (1.0 - min_weight_spherical) * math.sin(relative_height_top * math.pi)
            
            # Get top-layer center point for scaling reference
            top_scale_center_x = sum(p.X for p in top_cap_pts_morphed) / len(top_cap_pts_morphed)
            top_scale_center_y = sum(p.Y for p in top_cap_pts_morphed) / len(top_cap_pts_morphed)
            top_scale_center = rg.Point3d(top_scale_center_x, top_scale_center_y, 0)
            
            top_cap_pts_scaled = []
            for i, pt in enumerate(top_cap_pts_morphed):
                # Start and end points are not scaled (keep XY fixed)
                if i == 0 or i == (len(top_cap_pts_morphed) - 1):
                    top_cap_pts_scaled.append(pt)
                else:
                    # Only middle points are scaled, using dynamic spherical weights
                    vec_x = pt.X - top_scale_center.X
                    vec_y = pt.Y - top_scale_center.Y
                    scaled_vec_x = vec_x * spherical_weight_top
                    scaled_vec_y = vec_y * spherical_weight_top
                    pt_scaled = rg.Point3d(top_scale_center.X + scaled_vec_x, top_scale_center.Y + scaled_vec_y, pt.Z)
                    top_cap_pts_scaled.append(pt_scaled)
            
            deformed_top_curve = safe_create_curve(top_cap_pts_scaled)
            if deformed_top_curve: warped_curves.Add(deformed_top_curve, GH_Path(0))
            all_final_pts_matrix[0] = top_cap_pts_scaled

            # ==========================================
            # 🧱 4. Full-Cabin Body Layer Position Equalization
            # ==========================================
            top_most_delta = max(0.001, raw_curves[0].PointAtStart.Z - z_neutral)
            allowed_space_top = (box_top_pts[0].Z - z_neutral) * 0.85
            scale_factor_top = min(1.0, max(0.1, allowed_space_top / top_most_delta))
            
            btm_most_delta = max(0.001, z_neutral - raw_curves[-1].PointAtStart.Z)
            allowed_space_btm = (z_neutral - box_btm_pts[0].Z) * 0.85
            scale_factor_btm = min(1.0, max(0.1, allowed_space_btm / btm_most_delta))

            for l_idx, crv in enumerate(raw_curves):
                current_matrix_idx = l_idx + 1
                orig_pts = get_pts(crv, master_count)
                if not orig_pts: continue
                
                delta_z_start = orig_pts[0].Z - z_neutral
                delta_z_end = orig_pts[-1].Z - z_neutral
                
                delta_z_geom.append(rg.Point3d(orig_pts[0].X, orig_pts[0].Y, orig_pts[0].Z))
                delta_z_geom.append(rg.Point3d(orig_pts[-1].X, orig_pts[-1].Y, orig_pts[-1].Z))
                
                is_layer_top = delta_z_start >= 0
                
                if is_layer_top:
                    z_safe_start = z_neutral + abs(delta_z_start) * scale_factor_top
                    z_safe_end   = z_neutral + abs(delta_z_end) * scale_factor_top
                else:
                    z_safe_start = z_neutral - abs(delta_z_start) * scale_factor_btm
                    z_safe_end   = z_neutral - abs(delta_z_end) * scale_factor_btm

                p_safe_start = rg.Point3d(box_top_pts[0].X if is_layer_top else box_btm_pts[0].X, box_top_pts[0].Y if is_layer_top else box_btm_pts[0].Y, z_safe_start)
                p_safe_end = rg.Point3d(box_top_pts[-1].X if is_layer_top else box_btm_pts[-1].X, box_top_pts[-1].Y if is_layer_top else box_btm_pts[-1].Y, z_safe_end)
                z_safe_geom.append(p_safe_start)
                z_safe_geom.append(p_safe_end)

                layer_new_pts = []
                for i in range(master_count):
                    t = i / (master_count - 1.0)
                    dist_from_center = abs(i - 14.5) / 14.5
                    weight = math.cos(dist_from_center * math.pi / 2.0)
                    
                    z_base_safe = z_safe_start * (1.0 - t) + z_safe_end * t
                    z_final = (1.0 - weight) * z_base_safe + weight * orig_pts[i].Z
                    
                    if i == 0:
                        layer_new_pts.append(p_safe_start)
                    elif i == (master_count - 1):
                        layer_new_pts.append(p_safe_end)
                    else:
                        layer_new_pts.append(rg.Point3d(orig_pts[i].X, orig_pts[i].Y, z_final))
                
                crv_final = safe_create_curve(layer_new_pts)
                if crv_final: warped_curves.Add(crv_final, GH_Path(current_matrix_idx))
                all_final_pts_matrix[current_matrix_idx] = layer_new_pts

            # ==========================================
            # 🧱 5. Weaving Generation: Foot Bottom-Level Control Surface (Matrix[-1]) -> 🦋 [Morph Blending - Option B]
            # ==========================================
            btm_layout_pts = get_pts(raw_curves[-1], master_count)
            
            # 🌟 Initial State: Use smaller inflation (still has a foot when morph_val=0, but more gentle)
            btm_cap_pts_initial = []
            initial_offset_factor = 0.3  # Initial state has only 30% inflation intensity
            for i in range(master_count):
                dist_from_center = abs(i - 14.5) / 14.5
                weight = math.cos(dist_from_center * math.pi / 2.0)
                
                if i == 0:
                    z_pan_initial = adjusted_box_btm_pts[0].Z
                elif i == (master_count - 1):
                    z_pan_initial = adjusted_box_btm_pts[-1].Z
                else:
                    # Use inflation logic in the middle, smooth transition when approaching the start and end
                    dist_from_edge = min(i, master_count - 1 - i)
                    edge_factor = max(0, min(1.0, (dist_from_edge - 1) / 2))
                    z_deflated = z_min_body - weight * (dynamic_btm_offset * initial_offset_factor)
                    z_pan_initial = z_deflated * edge_factor + adjusted_box_btm_pts[i].Z * (1.0 - edge_factor)
                
                if i == 0:
                    btm_cap_pts_initial.append(rg.Point3d(adjusted_box_btm_pts[0].X, adjusted_box_btm_pts[0].Y, z_pan_initial))
                elif i == (master_count - 1):
                    btm_cap_pts_initial.append(rg.Point3d(adjusted_box_btm_pts[-1].X, adjusted_box_btm_pts[-1].Y, z_pan_initial))
                else:
                    btm_cap_pts_initial.append(rg.Point3d(btm_layout_pts[i].X, btm_layout_pts[i].Y, z_pan_initial))
            
            # 🌟 Inflated State: Original calculation method (full inflation)
            btm_cap_pts_final = []
            for i in range(master_count):
                dist_from_center = abs(i - 14.5) / 14.5
                weight = math.cos(dist_from_center * math.pi / 2.0)
                
                if i == 0:
                    z_pan_final = adjusted_box_btm_pts[0].Z
                elif i == (master_count - 1):
                    z_pan_final = adjusted_box_btm_pts[-1].Z
                else:
                    # Use inflation logic in the middle, smooth transition when approaching the start and end
                    dist_from_edge = min(i, master_count - 1 - i)
                    edge_factor = max(0, min(1.0, (dist_from_edge - 1) / 2))
                    z_deflated = z_min_body - weight * dynamic_btm_offset
                    z_pan_final = z_deflated * edge_factor + adjusted_box_btm_pts[i].Z * (1.0 - edge_factor)
                
                if i == 0:
                    btm_cap_pts_final.append(rg.Point3d(adjusted_box_btm_pts[0].X, adjusted_box_btm_pts[0].Y, z_pan_final))
                elif i == (master_count - 1):
                    btm_cap_pts_final.append(rg.Point3d(adjusted_box_btm_pts[-1].X, adjusted_box_btm_pts[-1].Y, z_pan_final))
                else:
                    btm_cap_pts_final.append(rg.Point3d(btm_layout_pts[i].X, btm_layout_pts[i].Y, z_pan_final))
            
            # 🦋 Morph Interpolation: Initial State -> Inflated State
            btm_cap_pts_morphed = []
            for i in range(master_count):
                pt_0 = btm_cap_pts_initial[i]
                pt_1 = btm_cap_pts_final[i]
                pt_m = pt_0 + (pt_1 - pt_0) * morph_val
                btm_cap_pts_morphed.append(pt_m)
            
            # 🔍 DEBUG: Print start and end point heights for foot bottom (btm_cap_pts)
            print("="*80)
            print("🔍 [DEBUG] Start and end point heights for foot bottom (btm_cap_pts):")
            print(f"\ninitial state (when morph=0):")
            print(f"   btm_cap_pts_initial[0].Z = {btm_cap_pts_initial[0].Z:.4f}")
            print(f"   btm_cap_pts_initial[-1].Z = {btm_cap_pts_initial[-1].Z:.4f}")
            print(f"\nfinal state (when morph=1):")
            print(f"   btm_cap_pts_final[0].Z = {btm_cap_pts_final[0].Z:.4f}")
            print(f"   btm_cap_pts_final[-1].Z = {btm_cap_pts_final[-1].Z:.4f}")
            print(f"\nmorphed state (at morph={morph_val:.2f}):")
            print(f"   btm_cap_pts_morphed[0].Z = {btm_cap_pts_morphed[0].Z:.4f}")
            print(f"   btm_cap_pts_morphed[-1].Z = {btm_cap_pts_morphed[-1].Z:.4f}")
            print("="*80)
            
            # 🦋 Apply spherical scaling to deformed_btm_curve (consistent with Component 1)
            # 🌟 Calculate the spherical weight corresponding to this height (lowest layer relative_height = 0.0)
            relative_height_btm = 0.0  # Lowest layer
            spherical_weight_btm = min_weight_spherical + (1.0 - min_weight_spherical) * math.sin(relative_height_btm * math.pi)
            
            # Get bottom-layer center point for scaling reference
            btm_scale_center_x = sum(p.X for p in btm_cap_pts_morphed) / len(btm_cap_pts_morphed)
            btm_scale_center_y = sum(p.Y for p in btm_cap_pts_morphed) / len(btm_cap_pts_morphed)
            btm_scale_center = rg.Point3d(btm_scale_center_x, btm_scale_center_y, 0)
            
            btm_cap_pts_scaled = []
            for i, pt in enumerate(btm_cap_pts_morphed):
                # Start and end points are not scaled (keep XY fixed)
                if i == 0 or i == (len(btm_cap_pts_morphed) - 1):
                    btm_cap_pts_scaled.append(pt)
                else:
                    # Only middle points are scaled, using dynamic spherical weights
                    vec_x = pt.X - btm_scale_center.X
                    vec_y = pt.Y - btm_scale_center.Y
                    scaled_vec_x = vec_x * spherical_weight_btm
                    scaled_vec_y = vec_y * spherical_weight_btm
                    pt_scaled = rg.Point3d(btm_scale_center.X + scaled_vec_x, btm_scale_center.Y + scaled_vec_y, pt.Z)
                    btm_cap_pts_scaled.append(pt_scaled)
            
            deformed_btm_curve = safe_create_curve(btm_cap_pts_scaled)
            if deformed_btm_curve: warped_curves.Add(deformed_btm_curve, GH_Path(num_layers + 1))
            all_final_pts_matrix[-1] = btm_cap_pts_scaled

            # ==========================================
            # 🧱 6. Longitudinal Stitching and Seaming Workshop (🌟 Boundary End Closure Small Arcs Filtered Independently)
            # ==========================================
            target_rib_ids = []
            if 'Peak_Indices' in globals() and Peak_Indices is not None:
                for path in Peak_Indices.Paths:
                    for idx in Peak_Indices.Branch(path):
                        if idx is not None: target_rib_ids.append(int(idx))

            try:
                left_arc = rg.Arc(adjusted_box_top_pts[1], adjusted_box_top_pts[0], adjusted_box_btm_pts[1])
                rib_lines.append(rg.ArcCurve(left_arc))
            except: pass

            try:
                right_arc = rg.Arc(adjusted_box_top_pts[28], adjusted_box_top_pts[29], adjusted_box_btm_pts[28])
                rib_lines.append(rg.ArcCurve(right_arc))
                
            except: pass

            for i in range(master_count):
                if i == 0 or i == (master_count - 1):
                    continue
                    
                rib_path = GH_Path(i)
                rib_pts = []
                rib_pts.append(adjusted_box_top_pts[i])
                for j in range(total_layer_count):
                    if all_final_pts_matrix[j] is not None:
                        p = all_final_pts_matrix[j][i]
                        if p.DistanceTo(rib_pts[-1]) > 0.0001:
                            rib_pts.append(p)
                if adjusted_box_btm_pts[i].DistanceTo(rib_pts[-1]) > 0.0001:
                    rib_pts.append(adjusted_box_btm_pts[i])

                for pt in rib_pts:
                    rib_points.Add(pt, rib_path)

                if i in target_rib_ids:
                    for pt in rib_pts:
                        highlighted_ribs.Add(rg.Point3d(pt.X, pt.Y, pt.Z), rib_path)
                
            out_msg = "✅ Pole truncation successful! Now supporting Morph_Factor control for head and foot inflation! Current deformation progress: {:.1f}%".format(morph_val * 100)

except Exception as e:
    out_msg = "🚨 Runtime Crash: " + str(e)
    print(traceback.format_exc())

# 🔍 DEBUG: Print start and end endpoints of all curves in warped_curves
print("="*60)
print("🔍 [DEBUG] Start and end endpoint information for all curves in warped_curves:")
print(f"warped_curves branches count: {len(warped_curves.Branches)}")
for branch_idx, branch in enumerate(warped_curves.Branches):
    if len(branch) > 0:
        crv = branch[0]
        print(f"\n[Branch {branch_idx}]")
        print(f"   PointAtStart: X={crv.PointAtStart.X:.4f}, Y={crv.PointAtStart.Y:.4f}, Z={crv.PointAtStart.Z:.4f}")
        print(f"   PointAtEnd:   X={crv.PointAtEnd.X:.4f}, Y={crv.PointAtEnd.Y:.4f}, Z={crv.PointAtEnd.Z:.4f}")
print("="*60)

# --- 📤 7. Direct Rigid Mapping Port Outputs ---
warped_curves = warped_curves
deformed_top_curve = deformed_top_curve
deformed_btm_curve = deformed_btm_curve
neutral_curve = neutral_curve
neutral_plane_circle = neutral_plane_circle
rib_lines = rib_lines       
rib_points = rib_points
highlighted_ribs = highlighted_ribs
debug_points = debug_pts_geom       
z_safe = z_safe_geom
delta_z_start = delta_z_geom
sorted_raw_curves = sorted_raw_curves_geom
Adjusted_Top_Pts = adjusted_top_pts
Adjusted_Btm_Pts = adjusted_btm_pts
Move_Vector = move_vector  # 🌟 [New] Push vector output
out = out_msg
# ---------- end python_3_script_5 ----------
cull_duplicates_2 = CullDuplicates(Points=python_3_script_5.rib_points, Tolerance=Slider(0.2, range=0..1), CullMode=3)  # -> Points, Indices, Valence
polyline = PolyLine(Vertices=cull_duplicates_2.Points, Closed=False)  # -> flatten(Polyline)
polyline_2 = PolyLine(Vertices=cull_duplicates_2.Points, Closed=False)
list_item_11 = ListItem(List=flatten(python_3_script_5.warped_curves), Index=Slider(12, range=0..100), Wrap=True)
geometry_8 = Geometry(python_3_script_5.warped_curves)
merge_4 = Merge(Data1=polyline_2, Data2=python_3_script_5.warped_curves)

geometry_9 = Geometry(python_3_script_4.Out_Curves)
sphere_2 = Sphere(Base=python_3_script_4.peak_points, Radius=Slider(0.02, range=0..0.1))
vector_2 = Vector(python_3_script_5.Move_Vector)
geometry_10 = Geometry(python_3_script_5.Adjusted_Btm_Pts)
panel_17 = Panel(vector_2)
list_item_12 = ListItem(List=python_3_script_5.rib_lines, Index="0", Wrap=True)
list_item_13 = ListItem(List=python_3_script_5.rib_lines, Index="1", Wrap=True)
polyline_3 = PolyLine(Vertices=python_3_script_5.highlighted_ribs, Closed=False)  # -> flatten(Polyline)
cull_index_3 = CullIndex(List=polyline, Indices=panel_5, Wrap=True)

flip_curve_2 = FlipCurve(Curve=list_item_13)  # -> Curve, Flag
entwine = Entwine(Branch00=list_item_12, Branch01=cull_index_3, Branch02=flip_curve_2.Curve, FlattenInputs=True)  # -> flatten(Result)
fillet = Fillet(Curve=entwine, Radius=number_slider_11)  # -> flatten(Curve)

tree_branch = TreeBranch(Tree=geometry_8, Path=Slider(0, range=0..100), MaintainPaths=True)

dash_pattern_2 = DashPattern(Curve=python_3_script_4.Push_Rays_2, Pattern=panel_15)  # -> flatten(Dashes), Gaps
dash_pattern_3 = DashPattern(Curve=python_3_script_4.Out_Rays, Pattern=panel_15)  # -> flatten(Dashes), Gaps
custom_preview_4 = CustomPreview(Geometry=python_3_script_4.Skeleton_Lines, Material=ColourSwatch(SwatchColor=RGB(205, 70, 255)))
custom_preview_lineweights_6 = CustomPreviewLineweights(
    Geometry=tree_branch,
    Shader=ColourSwatch(SwatchColor=RGB(0, 43, 255)),
    Thickness=Slider(0.013, range=0..0.1),
    Absolute=boolean_toggle_2)
custom_preview_lineweights_7 = CustomPreviewLineweights(
    Geometry=dash_pattern_2.Dashes,
    Shader=ColourSwatch(SwatchColor=RGB(0, 0, 0)),
    Thickness=number_slider_12,
    Absolute=boolean_toggle_2)
custom_preview_lineweights_8 = CustomPreviewLineweights(
    Geometry=dash_pattern_3.Dashes,
    Shader=ColourSwatch(SwatchColor=RGB(255, 0, 0)),
    Thickness=number_slider_12,
    Absolute=boolean_toggle_2)
cluster = Cluster(tree=polyline_2, tree_2=polyline_2, progress=python_3_script_3.val_float)

fillet_2 = Fillet(Curve=polyline_3, Radius=number_slider_11)
dash_pattern_4 = DashPattern(Curve=fillet_2, Pattern=panel_6)  # -> flatten(Dashes), Gaps
dispatch = Dispatch(List=fillet, DispatchPattern=[False, False, False, True])  # -> ListA, ListB
list_item_14 = ListItem(List=polyline, Index=Slider(22, range=0..40), Wrap=True)
# Materialization
dispatch_2 = Dispatch(List=fillet, DispatchPattern=[False, False, False, False, False, False, False, False, False, False, True])  # -> ListA, ListB
pipe = Pipe(Curve=dispatch.ListA, Radius=Slider(0.008, range=0..0.01), Caps=2)  # -> flatten(Pipe)
list_item_15 = ListItem(List=pipe, Index=[Slider(0, range=0..100), Slider(1, range=0..1), Slider(2, range=0..10)], Wrap=True)
list_item_16 = ListItem(List=pipe, Index=Slider(3, range=0..10), Wrap=True)
list_item_17 = ListItem(List=pipe, Index=Slider(3, range=0..10), Wrap=True)
split_list = SplitList(List=pipe, Index=Slider(3, range=0..10))  # -> ListA, ListB
custom_preview_5 = CustomPreview(Geometry=list_item_16, Material=colour_swatch_2)
custom_preview_6 = CustomPreview(Geometry=list_item_17, Material=colour_swatch_2)

button = Button()
python_3_script_6 = Python3Script(P=cull_index_2, Reset=button)  # -> vector_lines, arrow_planes; inputs P: list of Point3d
# ---------- python_3_script_6: Python ----------
import Rhino.Geometry as rg

vector_lines = []
arrow_planes = []

# Dynamic scaling parameters
base_len = 0.4        # Standard length when a joint is exactly inline with the CORE
scale_factor = 0.8    # Sensitivity: higher numbers make the reach contrast more dramatic
min_len = 0.1         # Safety lock: prevents arrows from disappearing or flipping inside out

target_indices = [3, 0, 10, 6, 16, 12, 18, 14]

if P and len(P) > 0:
    core_idx = 0
    if core_idx < len(P):
        core_pt = P[core_idx]
        
        for idx in target_indices:
            if idx < len(P):
                start_pt = P[idx]
                
                # Calculate relative forward distance along the Y axis relative to CORE
                # (Since forward is -Y, core_y minus start_y yields positive value when ahead)
                forward_dist = core_pt.Y - start_pt.Y
                
                # Compute the adaptive dynamic length
                dynamic_len = base_len + (forward_dist * scale_factor)
                if dynamic_len < min_len:
                    dynamic_len = min_len
                
                # Generate the custom scale forward vector
                custom_vector = rg.Vector3d(0.0, -dynamic_len, 0.0)
                end_pt = start_pt + custom_vector
                
                # Output geometries
                line = rg.Line(start_pt, end_pt)
                vector_lines.append(line)
                
                base_plane = rg.Plane(end_pt, custom_vector)
                arrow_planes.append(base_plane)

vector_lines = vector_lines
arrow_planes = arrow_planes
# ---------- end python_3_script_6 ----------
python_3_script_7 = Python3Script(P=cull_index_2, Reset=button)  # -> current_pts, text_pts, text_planes, current_txt; inputs P: list of Point3d
# ---------- python_3_script_7: Python ----------
import Rhino.Geometry as rg
import math

inside_pts = []
inside_anchors = []
inside_planes = []
inside_txt = []

names = {
    3: "HEAD",
    0: "CORE",
    10: "HAND",
    6: "HAND",
    16: "KNEE",
    12: "KNEE",
    18: "TOE",
    14: "TOE"
}

base_len = 0.4
scale_factor = 0.8
min_len = 0.1
rotation_angle_degrees = -15.0

# 🎛️ POSITION SLIDER CONTROL (Exposed for easy tweaking)
# 0.0 = At the joint | 0.5 = EXACT MIDPOINT | 0.7 = Near the arrowhead
# Change this number anytime to slide the text along the slanted line!
position_on_line = 0.7  

# Vertical gap (nudges the text cleanly above the arrow line)
lift_z = 0.04 

if P and len(P) > 0:
    core_idx = 0
    if core_idx < len(P):
        core_pt = P[core_idx]
        
        angle_radians = math.radians(rotation_angle_degrees)
        rotation_hinge = rg.Vector3d.XAxis
        
        for idx, name in names.items():
            if idx < len(P):
                start_pt = P[idx]
                semantic_name = "V-" + name
                
                forward_dist = core_pt.Y - start_pt.Y
                dynamic_len = base_len + (forward_dist * scale_factor)
                if dynamic_len < min_len:
                    dynamic_len = min_len
                
                # Reconstruct the exact synchronized rotated vector
                custom_vector = rg.Vector3d(0.0, -dynamic_len, 0.0)
                custom_vector.Rotate(angle_radians, rotation_hinge)
                
                # Slide along the vector precisely using the position_on_line factor
                target_pt = start_pt + (custom_vector * position_on_line)
                final_text_pt = rg.Point3d(target_pt.X, target_pt.Y, target_pt.Z + lift_z)
                
                # Construct oriented view plane for alignment
                view_plane = rg.Plane(final_text_pt, rg.Vector3d(0, -1, 0), rg.Vector3d(0, 0, 1))
                view_plane.Rotate(angle_radians, rotation_hinge)
                
                inside_pts.append(start_pt)
                inside_anchors.append(final_text_pt)
                inside_planes.append(view_plane)
                inside_txt.append(semantic_name)

current_pts = inside_pts
text_pts = inside_anchors
text_planes = inside_planes
current_txt = inside_txt
# ---------- end python_3_script_7 ----------
python_3_script_8 = Python3Script(P=cull_index_2, Reset=button)  # -> current_pts, text_pts, current_txt; inputs P: list of Point3d
# ---------- python_3_script_8: Python ----------
import Rhino.Geometry as rg

current_pts = []
text_pts = []
current_txt = []

names = {
    3: "HEAD",
    0: "CORE",
    10: "R_HAND",
    16: "R_KNEE",
    18: "R_TOE"
}

# Adjust these numbers to move the labels further or closer
# Based on your Right View: offset_y moves horizontally, offset_z moves vertically
offset_y = 0.15
offset_z = -0.15

if P and len(P) > 0:
    for j_idx in [3, 0, 10, 16, 18]:
        if j_idx < len(P):
            pt = P[j_idx]
            label_text = "{}[{:.1f}, {:.1f}, {:.1f}]".format(names[j_idx], pt.X, pt.Y, pt.Z)
            
            # Generate a new shifted point for text alignment
            shifted_pt = rg.Point3d(pt.X, pt.Y + offset_y, pt.Z + offset_z)
            
            current_pts.append(pt)
            text_pts.append(shifted_pt)
            current_txt.append(label_text)

current_pts = current_pts
text_pts = text_pts
current_txt = current_txt
# ---------- end python_3_script_8 ----------
python_3_script_9 = Python3Script(P=cull_index_2, Reset=button)  # -> current_pts, text_pts, current_txt; inputs P: list of Point3d
# ---------- python_3_script_9: Python ----------
import Rhino.Geometry as rg

current_pts = []
text_pts = []
current_txt = []

# Strictly curated representative joints for clean diagram aesthetics
names = {
    3: "HEAD",
    0: "CORE",
    10: "R_HAND",
    6: "L_HAND",
    16: "R_KNEE",
    12: "L_KNEE",
    18: "R_TOE",
    14: "L_TOE"
}

offset_y = 0.15
offset_z = -0.15

if P and len(P) > 0:
    for idx, name in names.items():
        if idx < len(P):
            pt = P[idx]
            
            # Generate the shifted anchor point for text alignment
            shifted_pt = rg.Point3d(pt.X, pt.Y + offset_y, pt.Z + offset_z)
            
            current_pts.append(pt)
            text_pts.append(shifted_pt)
            current_txt.append(name)


current_pts = current_pts
text_pts = text_pts
current_txt = current_txt
# ---------- end python_3_script_9 ----------
python_3_script_10 = Python3Script(P=move_6.Geometry)  # -> Skeleton; inputs P: list
# ---------- python_3_script_10: Python ----------
import Rhino.Geometry as rg

lines = []

bone_connections = [
    (3, 7),
    (7, 2),
    (2, 1),
    (1, 0),
    
    (7, 8),
    (8, 9),
    (9, 10),
    
    (7, 4),
    (4, 5),
    (5, 6),
    
    (0, 15),
    (15, 16),
    (16, 17),
    (17, 18),
    
    (0, 11),
    (11, 12),
    (12, 13),
    (13, 14)
]

for start, end in bone_connections:
    if start < len(P) and end < len(P):
        line = rg.Line(P[start], P[end])
        lines.append(line)

Skeleton = lines
# ---------- end python_3_script_10 ----------
colour_swatch_6 = ColourSwatch(SwatchColor=RGB(0, 43, 255))
cone_2 = Cone(Base=python_3_script_6.arrow_planes, Radius=Slider(0.02, range=0..0.1), Length=Slider(0.1, range=0..1))  # -> Cone, Tip
end_points = EndPoints(Curve=python_3_script_6.vector_lines)  # -> Start, End
text_tag_3d = TextTag3D(
    Location=python_3_script_7.text_pts,
    Text=python_3_script_7.current_txt,
    Size=Slider(0.052, range=0..1),
    Colour=colour_swatch_6,
    Justification=7)
custom_preview_lineweights_9 = CustomPreviewLineweights(Geometry=dash_pattern_4.Dashes, Shader=colour_swatch_6, Thickness=Slider(2, range=0..10), Absolute=False)
custom_preview_lineweights_10 = CustomPreviewLineweights(Geometry=python_3_script_6.vector_lines, Shader=colour_swatch_6, Thickness=Slider(1, range=0..1), Absolute=False)
custom_preview_7 = CustomPreview(Geometry=sphere_2, Material=colour_swatch_6)
custom_preview_lineweights_11 = CustomPreviewLineweights(Geometry=python_3_script_10, Shader=colour_swatch_6, Thickness=Slider(1, range=0..10), Absolute=False)
text_tag = TextTag(Location=python_3_script_8.text_pts, Text=python_3_script_8.current_txt)
text_tag_2 = TextTag(Location=python_3_script_9.text_pts, Text=python_3_script_9.current_txt)

# ---- group: Materialization
loft = Loft(Curves=fillet, Options={Adjust=True, Closed=False, LoftEnds=0, LoftSimp=1, LoftType=2, Rebuild=40, Refit=0.01})
mesh_brep = MeshBrep(
    Brep=loft,
    Settings={GridMaxCount=0, GridMinCount=17, JaggedSeams=False, MaxEdgeLength=5, MinEdgeLength=0.1, MinTolerance=0, Refine=True, RefineAngle=0, RelativeTolerance=0.65, SimplePlanes=True, Tolerance=0})
pipe_2 = Pipe(Curve=dispatch_2.ListA, Radius=1, Caps=2)  # -> flatten(Pipe)
custom_preview_8 = CustomPreview(Geometry=pipe, Material=ColourSwatch(SwatchColor=RGB(255, 255, 255)))

# ----
weaverbird_s_catmull_clark_subdivision = WeaverbirdsCatmullClarkSubdivision(MeshCurves=mesh_brep, Level=Slider(1, range=0..10), SmoothNakedEdges=1)  # -> flatten(OutputMeshCurves)
custom_preview_9 = CustomPreview(Geometry=mesh_brep, Material="Ground")

# ---- group: Materialization (continued)
custom_preview_10 = CustomPreview(Geometry=weaverbird_s_catmull_clark_subdivision, Material="MyFilm")

# ----
mesh_edges = MeshEdges(Mesh=mesh_brep)  # -> NakedEdges, InteriorEdges, NonManifoldEdges
surface = Surface(<surface referenced from the Rhino model>)
number_slider_13 = Slider(0, range=0..1)
evaluate_curve_3 = EvaluateCurve(Curve=reparameterize(mesh_edges.InteriorEdges), Parameter=Slider(0.5, range=0..1))  # -> Point, Tangent, Angle
mesh = Mesh(<mesh referenced from the Rhino model>)
mesh_split = MeshSplit(Splitters=surface)
mesh_split_2 = MeshSplit(Mesh=mesh_brep, Splitters=surface)
deconstruct_4 = Deconstruct(Point=evaluate_curve_3.Point)  # -> XComponent, YComponent, ZComponent
list_item_18 = ListItem(List=mesh_split, Index=number_slider_13, Wrap=True)
list_item_19 = ListItem(List=mesh_split_2, Index=Slider(0, range=0..1), Wrap=True)
mesh_split_3 = MeshSplit(Mesh=weaverbird_s_catmull_clark_subdivision, Splitters=mesh)
negative_6 = Negative(Value=Slider(1, range=0..1))
list_item_20 = ListItem(List=mesh_split_3, Index=Slider(1, range=0..100), Wrap=True)
scale_nu = ScaleNU(Geometry=list_item_20, Plane=PlaneXY(0, 0, 0), ScaleX=1, ScaleY=Slider(1, range=0..1), ScaleZ=1)  # -> Geometry, Transform
unit_z_4 = UnitZ(Factor=negative_6)
unit_x_3 = UnitX(Factor=Slider(1, range=0..10))
move_8 = Move(Geometry=scale_nu.Geometry, Motion=unit_z_4)  # -> Geometry, Transform
custom_preview_11 = CustomPreview(Geometry=move_8.Geometry, Material="LUNAR_SURFACE")

move_9 = Move(Geometry=surface, Motion=unit_x)  # -> Geometry, Transform
geometry_11 = Geometry(mesh_edges.InteriorEdges)

area_4 = Area(Geometry=move_9.Geometry)  # -> Area, Centroid
mesh_split_4 = MeshSplit(Mesh=flatten(weaverbird_s_catmull_clark_subdivision), Splitters=move_9.Geometry)
deconstruct_5 = Deconstruct(Point=area_4.Centroid)  # -> XComponent, YComponent, ZComponent
# Section View
list_item_21 = ListItem(List=mesh_split_4, Index=number_slider_13, Wrap=True)
larger_than = LargerThan(FirstNumber=deconstruct_5.XComponent, SecondNumber=deconstruct_4.XComponent)  # -> LargerThan, OrEqualTo
panel_18 = Panel(list_item_21)
dispatch_3 = Dispatch(List=geometry_11, DispatchPattern=larger_than.LargerThan)  # -> ListA, ListB
mesh_plane = MeshPlane(Mesh=weaverbird_s_catmull_clark_subdivision, Plane=move_9.Geometry)
pipe_3 = Pipe(Curve=dispatch_3.ListA, Radius=Slider(0.005, range=0..0.01), Caps=0)
pipe_4 = Pipe(Curve=dispatch_3.ListA, Radius=Slider(0.0025, range=0..0.01), Caps=0)
move_10 = Move(Geometry=[list_item_19, pipe_4], Motion=unit_x_3)  # -> Geometry, Transform
custom_preview_12 = CustomPreview(Geometry=pipe_4, Material=ColourSwatch(SwatchColor=RGB(0, 42, 255)))
custom_preview_13 = CustomPreview(Geometry=pipe_3, Material=ColourSwatch(SwatchColor=RGB(250, 0, 0)))
custom_preview_lineweights_12 = CustomPreviewLineweights(
    Geometry=mesh_plane,
    Shader=ColourSwatch(SwatchColor=RGB(0, 23, 135)),
    Thickness=Slider(0.012, range=0..0.1),
    Absolute=Toggle(True))

custom_preview_14 = CustomPreview(Geometry=list_item_18, Material=flatten("Ground"))

# ==== cluster Cluster
tree = ClusterInput()
tree_statistics = TreeStatistics(Tree=tree)  # -> Paths, Length, Count
list_item = ListItem(List=tree_statistics.Paths, Index=Slider(14, range=0..40), Wrap=True)
tree_2 = ClusterInput()
tree_branch = TreeBranch(Tree=tree_2, Path=list_item, MaintainPaths=True)
explode = Explode(Curve=tree_branch, Recursive=True)  # -> Segments, Vertices
evaluate_curve = EvaluateCurve(Curve=reparameterize(explode.Segments), Parameter=Slider(0.5, range=0..1))  # -> Point, Tangent, Angle
unit_x = UnitX(Factor=Slider(0.1, range=0..0.1))
progress = ClusterInput()
move = Move(Geometry=evaluate_curve.Point, Motion=unit_x)  # -> Geometry, Transform
python_3_script = Python3Script(Progress=progress)  # -> P_Text
# ---------- python_3_script: Python ----------
# -*- coding: utf-8 -*-
"""
【组件：软体驱动器多通道异步气压仿真器 ── 答辩级无趋势硬核版】
逻辑约束：严格限制在 0.0 - 220.0 kPa 范围内，但 10 通道完全异步独立
"""

import Rhino.Geometry as rg
import math

# 将 Progress 理解为时间轴/帧率驱动 (Time Tick)
t = float(Progress) if Progress is not None else 0.0

pressures = []

# 为 10 个通道各自设计一套完全不同的“物理伪随机特性参数”
# 包含不同的基础频率、振幅、和垂直偏移，彻底打乱统一趋势
channel_profiles = [
    {"freq": 4.5,  "amp": 80,  "base": 110},  # 通道 0: 中间高频震荡
    {"freq": 1.2,  "amp": 105, "base": 105},  # 通道 1: 超大范围慢速波动 (接近0-210)
    {"freq": 8.0,  "amp": 25,  "base": 195},  # 通道 2: 始终在高位极限内卷区微幅颤动 (170-220)
    {"freq": 2.3,  "amp": 60,  "base": 70},   # 通道 3: 中低位平缓游走
    {"freq": 6.1,  "amp": 45,  "base": 150},  # 通道 4: 中高位快速波摆
    {"freq": 0.8,  "amp": 90,  "base": 100},  # 通道 5: 极慢随动
    {"freq": 12.0, "amp": 15,  "base": 40},   # 通道 6: 低位高频脉冲微动 (类似传感器杂讯)
    {"freq": 3.7,  "amp": 75,  "base": 120},  # 通道 7: 异步交错波
    {"freq": 1.9,  "amp": 110, "base": 110},  # 通道 8: 几乎能吃满 0-220 全量程的独立单元
    {"freq": 5.2,  "amp": 35,  "base": 175}   # 通道 9: 偏极限弯曲段的异步通量
]

for i, profile in enumerate(channel_profiles):
    # 使用各自的专用频率和时间轴 t 计算波形
    # 加入 i * 1.5 的相位偏移，防止它们在 t=0 时同时出发
    wave = math.sin(t * profile["freq"] + i * 1.5)
    
    # 部分通道引入二次谐波，让变化轨迹变成非线性的非标准正弦，更像真实气压回流
    if i % 3 == 0:
        wave += 0.3 * math.cos(t * profile["freq"] * 2.1)
        
    # 计算当前通道的假数据气压
    val = profile["base"] + wave * profile["amp"]
    
    # 💥 终极物理屏障：无论数据怎么乱晃，绝对不能超越你那张图表的科学事实
    final_pressure = max(0.0, min(220.0, val))
    
    pressures.append(final_pressure)

# ==========================================
# 📤 黄金对齐输出
# ==========================================
P_List = pressures
P_Text = ["{:.1f} kPa".format(val) for val in pressures]
Avg_Pressure = sum(pressures) / len(pressures)
# ---------- end python_3_script ----------
text_tag = TextTag(Location=move.Geometry, Text=python_3_script, Colour=ColourSwatch(SwatchColor=RGB(255, 0, 0)))
